# Grasshopper definition lineline.gh (Grasshopper 1.0.7)

forked = Point([Point(-5, 0, 0), Point(5, 0, 0), Point(0, 0, 0), Point(5, 5, 0)])
colinear = Point([Point(-5, 0, 0), Point(10, 0, 0), Point(0, 0, 0), Point(5, 0, 0)])
interactive = Point([Point(20.32147583, -9.430813446, 0), Point(-4.936283085, -19.09623743, 0), Point(14.30338164, -19.6433369, 0), Point(30.07808306, -2.500886813, 0)])
regular = Point([Point(-5, 5, 0), Point(5, -5, 0), Point(-5, -5, 0), Point(5, 5, 0)])
forked_2 = Point([Point(-5, 0, 0), Point(5, 0, 0), Point(-5, 5, 0), Point(0, 0, 0)])
parallel = Point([Point(-5, 5, 0), Point(5, 5, 0), Point(-5, -5, 0), Point(5, -5, 0)])
disjoint = Point([Point(-5, 5, 0), Point(5, 5, 0), Point(0, -5, -5), Point(0, -5, 5)])
point = Point(interactive)

# ---- group: Double Dots
int = GhPythonScript(points=point)  # -> messages, geometry; inputs points: list of Point3d
# ---------- int: Python ----------
from Rhino.Geometry import *

def LineLine( a, b, c, d ):
    u = b - a
    v = d - c
    w = c - a
    
    uu, vv, uv = u * u, v * v, u * v
    uw, vw     = u * w, v * w
    
    d = uv * uv - vv * uu
    if( abs( d ) <= 1e-5 ):
        return False, d, 0.0
        
    s = ( uv * vw - vv * uw ) / d
    t = ( uu * vw - uv * uw ) / d
    return True, s, t

geometry = []

a, b, c, d = points

success, s, t = LineLine( a, b, c, d )    
print( 'Success' if success else 'Failure' )

print( 's: {:>8.5f}'.format( s ) )
print( 't: {:>8.5f}'.format( t ) )
# ---------- end int ----------
panel = Panel(int.messages)

# ----
list_item = ListItem(List=point, Index=0, Wrap=True)  # -> Item, Item1, Item2, Item3

# ---- group: Rhino
int_2 = GhPythonScript(points=point)  # -> messages, geometry; inputs points: list of Point3d
# ---------- int_2: Python ----------
from Rhino.Geometry import *
from Rhino.Geometry.Intersect import *

a, b, c, d = points

success, s, t = Intersection.LineLine(
    Line( a, b ),
    Line( c, d ) )

if( success ):
    p = a * ( 1 - s ) + b * s
    q = c * ( 1 - t ) + d * t
    print( 'Success' )
    geometry = [p, q]
else:
    print( 'Failure' )

print( 's: {:>8.5f}'.format( s ) )
print( 't: {:>8.5f}'.format( t ) )
# ---------- end int_2 ----------
panel_2 = Panel(int_2.messages)

# ---- group: Constructive Geometry
int_3 = GhPythonScript(points=point)  # -> messages, geometry; inputs points: list of Point3d
# ---------- int_3: Python ----------
from Rhino.Geometry import *

def LineLine( a, b, c, d ):
    ''' Orthonormal ( a, b, c ) Basis
    '''
    o = a
    u = b - o
    n = Vector3d.CrossProduct( u, c - o )
    v = Vector3d.CrossProduct( n, u )
    
    u.Unitize( )
    v.Unitize( )
    n.Unitize( )

    ''' World to Local Mapping
    '''
    C = Point3d( u * ( c - o ), v * ( c - o ), 0 )
    D = Point3d( u * ( d - o ), v * ( d - o ), 0 )

    ''' Similar Triangles
    '''
    t = ( D.Y * C.X - D.X * C.Y ) / ( D.Y - C.Y )
    return t / a.DistanceTo( b )

try:
    a, b, c, d = points

    t = LineLine( a, b, c, d )    

    print( 'Success' )
    print( 't: {:>8.5f}'.format( t ) )
    geometry = [a * ( 1 - t ) + b * t]
except:
    print( 'Failure' )
# ---------- end int_3 ----------
panel_3 = Panel(int_3.messages)

# ---- group: Cross Dots / Fast
int_4 = GhPythonScript(points=point)  # -> messages, geometry; inputs points: list of Point3d
# ---------- int_4: Python ----------
from Rhino.Geometry import *

def LineLine( a, b, c, d ):
    u = b - a
    v = d - c
    w = c - a
    
    n = Vector3d.CrossProduct( u, v )
    s = Vector3d.CrossProduct( w, v ) * n / ( n * n )
    t = Vector3d.CrossProduct( w, u ) * n / ( n * n )
    return s, t

a, b, c, d = points

try:
    s, t = LineLine( a, b, c, d )    
    print( 'Success' )
    print( 's: {:>8.5f}'.format( s ) )
    print( 't: {:>8.5f}'.format( t ) )
except:
    print( 'Failure' )
# ---------- end int_4 ----------

# ---- group: Cross Dots / Safe
int_5 = GhPythonScript(points=point)  # -> messages, geometry; inputs points: list of Point3d
# ---------- int_5: Python ----------
from Rhino.Geometry import *

def LineLine( a, b, c, d ):
    u = b - a
    v = d - c
    x = d - a
    y = c - a
    
    n = Vector3d.CrossProduct( u, v )
    N = n * n
    if( N <= 1e-10 ):
        t = ( u * x ) / ( u * u )
        s = ( x - u * t ).Length
        if( s <= 1e-5 ):
            return 'Colinear Lines', s, t 
        else:
            return 'Parallel Lines', s, 0.0

    s = Vector3d.CrossProduct( x, v ) * n / N
    t = Vector3d.CrossProduct( y, u ) * n / N

    if( abs( x * n ) <= 1e-5 ):
        return 'Intersection !', s, t
    else:
        return 'Disjoint Lines', s, t

a, b, c, d = points

result, s, t = LineLine( a, b, c, d )    

print( result )
print( 's: {:>8.5f}'.format( s ) )
print( 't: {:>8.5f}'.format( t ) )
# ---------- end int_5 ----------

# ----
line = Line(StartPoint=list_item.Item2, EndPoint=list_item.Item3)
line_2 = Line(StartPoint=list_item.Item, EndPoint=list_item.Item1)

# ---- group: Cross Dots
panel_4 = Panel(int_4.messages)
panel_5 = Panel(int_5.messages)
