# Grasshopper definition lineplane.gh (Grasshopper 1.0.7)

point = Point([Point(60.29565845, 5.984731288, 4.6179574), Point(53.20777173, 4.886574336, 12.25172371), Point(72.6708645, -3.016277523, 0), Point(71.51494196, -7.869170897, 27.74759959)])
point_2 = Point([Point(60.29565845, 5.984731288, 4.6179574), Point(53.20777173, 4.886574336, 12.25172371), Point(72.6708645, -3.016277523, 0), Point(71.51494196, -7.869170897, 27.74759959)])

# ---- group: Rhino
int = GhPythonScript(points=point)  # -> messages, geometry; inputs points: list of Point3d
# ---------- int: Python ----------
from Rhino.Geometry import *
from Rhino.Geometry.Intersect import *

geometry = []

a, b, c, d = points

o, n = c, d - c; n.Unitize( )
geometry.append( Line( a, b ) )
geometry.append( Line( o, n ) )

success, t = Intersection.LinePlane( 
    Line( a, b ), Plane( o, n ) )
if( success ):
    point = a * ( 1 - t ) + b * t
    geometry.append( point )
    print( '{:>8.4f} {:>8.4f} {:>8.4f}'.format( point.X, point.Y, point.Z ) )
# ---------- end int ----------

# ---- group: Vector Math
int_2 = GhPythonScript(points=point_2)  # -> messages, geometry; inputs points: list of Point3d
# ---------- int_2: Python ----------
from Rhino.Geometry import *

def LinePlane( a, b, o, n, epsilon = 1e-5 ):
    u = b - a
    v = o - a
    d = n * u
    if( abs( d ) <= epsilon ):
        return False, a
    return True, ( n * v ) / d

geometry = []

a, b, c, d = points

o, n = c, d - c; n.Unitize( )
geometry.append( Line( a, b ) )
geometry.append( Line( o, n ) )

success, t = LinePlane( a, b, o, n )
if( success ):
    point = a * ( 1 - t ) + b * t
    geometry.append( point )
    print( '{:>8.4f} {:>8.4f} {:>8.4f}'.format( point.X, point.Y, point.Z ) )
else:
    print( 'Failed' )
# ---------- end int_2 ----------

# ----
panel = Panel(int_2.messages)
panel_2 = Panel(int.messages)
