# Grasshopper definition planeplane.gh (Grasshopper 1.0.7)

point = Point([Point(9.984180496, -2.193626036, 37.88307099), Point(12.07295247, 6.916004861, -1.502664522), Point(-17.83171672, 15.21459853, 0), Point(-10.07829481, 32.11931661, 37.41237048)])

# ---- group: Rhino
int = GhPythonScript(points=point)  # -> messages, geometry; inputs points: list of Point3d
# ---------- int: Python ----------
import math, random
from Rhino import RhinoApp, RhinoDoc
from Rhino.Geometry import *
from Rhino.Geometry.Intersect import *
from System.Drawing import Color

geometry = []

a, A, b, B = points

u = A - a; u.Unitize( )
v = B - b; v.Unitize( )

success, line = Intersection.PlanePlane(
    Plane( a, u ),
    Plane( b, v ) )
if( success ):
    geometry.append( line ) 
    geometry.append( line.From )
    o = line.From
    print( 'Distance from au plane {:.5f}'.format( u * ( o - a ) ) )
    print( 'Distance from bv plane {:.5f}'.format( v * ( o - b ) ) )
else: 
    print( 'Failed' )
# ---------- end int ----------

# ---- group: Using Triple Plane
int_2 = GhPythonScript(points=point)  # -> messages, geometry; inputs points: list of Point3d
# ---------- int_2: Python ----------
from Rhino.Geometry import *

def Det3x3( xx, yx, zx,
            xy, yy, zy,
            xz, yz, zz ):
    return ( xx * ( yy * zz - zy * yz ) -
             yx * ( xy * zz - zy * xz ) +
             zx * ( xy * yz - yy * xz ) )

def TriplePlane( a, u, b, v, c, n ):
    d = Vector3d( 
        u * Vector3d( a ),
        v * Vector3d( b ),
        n * Vector3d( c ) )

    D = Det3x3( u.X, u.Y, u.Z,
                v.X, v.Y, v.Z,
                n.X, n.Y, n.Z )
    if( D == 0.0 ): return False, D
    
    X = Det3x3( d.X, u.Y, u.Z,
                d.Y, v.Y, v.Z,
                d.Z, n.Y, n.Z )
                 
    Y = Det3x3( u.X, d.X, u.Z,
                v.X, d.Y, v.Z,
                n.X, d.Z, n.Z )

    Z = Det3x3( u.X, u.Y, d.X,
                v.X, v.Y, d.Y,
                n.X, n.Y, d.Z )

    return True, Point3d( X / D, Y / D, Z / D )

def PlanePlane( a, u, b, v ):
    n = Vector3d.CrossProduct( u, v )
    success, o = TriplePlane( a, u, b, v, ( a + b ) / 2, n )
    if( success ):
        return True, o, n
    return False, o, n


geometry = []

a, A, b, B = points

u = A - a; u.Unitize( )
v = B - b; v.Unitize( )

geometry.append( Line( a, u * 10 ) )
geometry.append( Line( b, v * 10 ) )


success, o, n = PlanePlane( a, u, b, v )
if( success ):
    geometry.append( Line( o, n * 10 ) )
    geometry.append( o )
    print( 'Distance from au plane {:.5f}'.format( u * ( o - a ) ) )
    print( 'Distance from bv plane {:.5f}'.format( v * ( o - b ) ) )  
else:
    print( 'Failed' )
# ---------- end int_2 ----------

# ---- group: Using Algebra
int_3 = GhPythonScript(points=point)  # -> messages, geometry; inputs points: list of Point3d
# ---------- int_3: Python ----------
from Rhino.Geometry import *

def PlanePlane( a, u, b, v, epsilon = 1e-10 ):
    ''' Line's Direction
    '''
    n = Vector3d.CrossProduct( u, v )
    if( n * n <= epsilon ):
        return False, Point3d.Origin, n
    n.Unitize( )

    ''' Compute Determinant
    '''
    vn = Vector3d.CrossProduct( v, n )
    nu = Vector3d.CrossProduct( n, u )
    d = 1.0 / ( u * vn )
    
    ''' Columns of Inverse
    '''
    x = vn * d
    y = nu * d

    ''' Point on Line
    '''
    au = Vector3d( a ) * u
    bv = Vector3d( b ) * v
    
    o = Point3d( au * x + bv * y )
    return True, o, n    



geometry = []

a, A, b, B = points

u = A - a; u.Unitize( )
v = B - b; v.Unitize( )

geometry.append( Line( a, u * 10 ) )
geometry.append( Line( b, v * 10 ) )


success, o, n = PlanePlane( a, u, b, v )
if( success ):
    geometry.append( Line( o, n * 10 ) )
    geometry.append( o )
        
    print( 'Distance from au plane {:.5f}'.format( u * ( o - a ) ) )
    print( 'Distance from bv plane {:.5f}'.format( v * ( o - b ) ) )
else:
    print( 'Failed' )
# ---------- end int_3 ----------

# ----
panel = Panel(int.messages)
panel_2 = Panel(int_3.messages)
panel_3 = Panel(int_2.messages)
