# Grasshopper definition tripleplane.gh (Grasshopper 1.0.7)

point = Point([Point(16.58275542, 21.57865721, 0), Point(16.68459501, 27.57250075, 0), Point(19.32031568, 13.85872182, 0), Point(25.32222404, 13.94514471, 0), Point(14.37244938, 9.848284904, 0), Point(14.09890673, 7.759447301, 6.363679509)])

# ---- group: Linear System
int = GhPythonScript(points=point)  # -> messages, geometry; inputs points: list of Point3d
# ---------- int: Python ----------
from Rhino.Geometry import *

def Det3x3( xx, yx, zx,
            xy, yy, zy,
            xz, yz, zz ):
    return ( xx * ( yy * zz - zy * yz ) -
             yx * ( xy * zz - zy * xz ) +
             zx * ( xy * yz - yy * xz ) )

def TriplePlane( a, u, b, v, c, n ):
    d = Vector3d( 
        u * Vector3d( a ),
        v * Vector3d( b ),
        n * Vector3d( c ) )

    D = Det3x3( u.X, u.Y, u.Z,
                v.X, v.Y, v.Z,
                n.X, n.Y, n.Z )
    if( abs( D ) <= 1e-10 ): return False, D
    
    X = Det3x3( d.X, u.Y, u.Z,
                d.Y, v.Y, v.Z,
                d.Z, n.Y, n.Z )
                 
    Y = Det3x3( u.X, d.X, u.Z,
                v.X, d.Y, v.Z,
                n.X, d.Z, n.Z )

    Z = Det3x3( u.X, u.Y, d.X,
                v.X, v.Y, d.Y,
                n.X, n.Y, d.Z )

    return True, Point3d( X / D, Y / D, Z / D )

geometry = []

a, A, b, B, c, C = points

u = A - a; u.Unitize( )
v = B - b; v.Unitize( )
n = C - c; n.Unitize( )

geometry.append( Line( a, u * 10 ) )
geometry.append( Line( b, v * 10 ) )
geometry.append( Line( c, n * 10 ) )

success, point = TriplePlane( a, u, b, v, c, n )
if( success ):
    geometry.append( point )
    print( '{:>8.4f} {:>8.4f} {:>8.4f}'.format( point.X, point.Y, point.Z ) )
else:
    print( 'Failed' )
# ---------- end int ----------

# ---- group: Rhino
int_2 = GhPythonScript(points=point)  # -> messages, geometry; inputs points: list of Point3d
# ---------- int_2: Python ----------
import math, random
from Rhino import RhinoApp, RhinoDoc
from Rhino.Geometry import *
from Rhino.Geometry.Intersect import *
from System.Drawing import Color

geometry = []

a, A, b, B, c, C = points

u = A - a; u.Unitize( )
v = B - b; v.Unitize( )
n = C - c; n.Unitize( )

geometry.append( Line( a, u * 10 ) )
geometry.append( Line( b, v * 10 ) )
geometry.append( Line( c, n * 10 ) )

success, point = Intersection.PlanePlanePlane(
    Plane( a, u ),
    Plane( b, v ),
    Plane( c, n ) )
if( success ):
    geometry.append( point )    
    print( '{:>8.4f} {:>8.4f} {:>8.4f}'.format( point.X, point.Y, point.Z ) )

pa = Plane( a, u )
pb = Plane( b, v )
pc = Plane( c, n )
pr = 10.0
geometry += Brep.CreatePlanarBreps( Circle( pa, pr ).ToNurbsCurve( ), 1e-5 )
geometry += Brep.CreatePlanarBreps( Circle( pb, pr ).ToNurbsCurve( ), 1e-5 )
geometry += Brep.CreatePlanarBreps( Circle( pc, pr ).ToNurbsCurve( ), 1e-5 )
# ---------- end int_2 ----------

# ----
panel = Panel(int.messages)
panel_2 = Panel(int_2.messages)
