# Grasshopper definition curves.gh (Grasshopper 1.0.7)

number_slider = Slider(0.169, range=0..1)
smooth = GhPythonScript(iterations=Slider(32, range=0..32), pinned=Slider(1, range=0..1))  # -> messages, geometry; inputs iterations: Int32, pinned: Boolean
# ---------- smooth: Python ----------
from Rhino import RhinoDoc
from Rhino.Geometry import *
from Rhino.Geometry.Intersect import *
from random import uniform, seed
import math

class Poly:
    def __init__( self, points ):
        self.Points = points
    
    """ Source/Start Point
    """
    @property
    def Source( self ):
        return self.Points[0]

    """ Target/End Point
    """
    @property
    def Target( self ):
        return self.Points[-1]

    """ Is Polyline Closed?
    """
    @property
    def IsClosed( self ):
        return self.Source.DistanceTo(
               self.Target ) <= 1e-5

    """ Line Segments Enumerator
    """
    @property
    def Segments( self ):
        for source, target in zip(
                self.Points[:-1], self.Points[1:] ):
            yield ( source, target )

    """ Length of Polyline
    """
    @property
    def Length( self ):
        return sum( [source.DistanceTo( target )
            for source, target in self.Segments] )

    def Average( self, points, pinned ):
        result = []
        if( pinned ): result.append( points[0] )
        for a, b in self.Segments:
            result.append( ( a + b ) / 2 )
        if( pinned ): result.append( points[-1] )
        return result
            
    def Smooth( self, iterations, pinned ):
        points = self.Points
        for _ in range( iterations ):
            points = self.Average( points, pinned )
        return Poly( points )
        
    def ToPolyline( self ):
        return Polyline( self.Points )
        
    def ToCurve( self ):
        return PolylineCurve( self.Points )        
        
geometry = []

""" Noisy Curve
"""
seed( 17 )
noise =  0.1
shift = 20.5

points = []
count = 50
for index in range( count ):
    n = uniform( -noise, noise )
    t = math.pi * 2 * index / ( count - 1 )
    x = shift + 2 * t / math.pi
    y = math.sin( t ) + n
    points.append( Point3d( x, y, 0 ) )

curve = Poly( points )

geometry.append( curve.ToPolyline( ) )

geometry.append( curve.Smooth( 
    iterations, pinned ).ToPolyline( ) )
# ---------- end smooth ----------
subd = GhPythonScript(count=Slider(4, range=0..8), weight=Slider(2, range=0..16))  # -> messages, geometry; inputs count: Int32
# ---------- subd: Python ----------
from Rhino import RhinoDoc
from Rhino.Geometry import *
from Rhino.Geometry.Intersect import *

class Poly:
    def __init__( self, points ):
        self.Points = points
    
    """ Source/Start Point
    """
    @property
    def Source( self ):
        return self.Points[0]

    """ Target/End Point
    """
    @property
    def Target( self ):
        return self.Points[-1]

    """ Is Polyline Closed?
    """
    @property
    def IsClosed( self ):
        return self.Source.DistanceTo(
               self.Target ) <= 1e-5

    """ Line Segments Enumerator
    """
    @property
    def Segments( self ):
        for source, target in zip(
                self.Points[:-1], self.Points[1:] ):
            yield ( source, target )

    """ Length of Polyline
    """
    @property
    def Length( self ):
        return sum( [source.DistanceTo( target )
            for source, target in self.Segments] )

    def Average( self, points, pinned ):
        result = []
        if( pinned ): result.append( points[0] )
        for a, b in self.Segments:
            result.append( ( a + b ) / 2 )
        if( pinned ): result.append( points[-1] )
        return result
            
    def Smooth( self, iterations, pinned ):
        points = self.Points
        for _ in range( iterations ):
            points = self.Average( points, pinned )
        return Poly( points )
        
    def ToPolyline( self ):
        return Polyline( self.Points )
        
    def ToCurve( self ):
        return PolylineCurve( self.Points )   
        
class SubDivisionCurve( Poly ):
    def __init__( self, points, weight = 2 ):
        Poly.__init__( self, points )
        scale = 1.0 / ( weight + 2 )
        self.Kernel = [scale, 
                       scale * weight, 
                       scale]
    
    def Evaluate( self, a, b, c ):
        A = ( a + b ) / 2
        C = ( b + c ) / 2

        wa, wb, wc = self.Kernel
        B = ( A * wa + b * wb + C * wc )

        return A, B, C

    def Subdivide( self, points, closed ):
        result = []        
        if( closed ):
            A, B, C = self.Evaluate( 
                points[-2], #-- skip -1
                points[ 0],
                points[ 1] )
            result.append( A )
            result.append( B )
        else:
            result.append( points[0] )
            
        for a, b, c in zip( 
                points[ :-2],
                points[1:-1], 
                points[2:  ] ):
            A, B, C = self.Evaluate( a, b, c )
            result.append( A )
            result.append( B )
        result.append( C )

        if( not closed ):
            result.append( points[-1] )
        return result
        
    def Approximate( self, iterations ):
        points = self.Points
        closed = self.IsClosed
        for iteration in range( iterations ):
            points = self.Subdivide( points, closed )
            print( iteration, len( points ) )
        return Poly( points )

geometry = []

curve = SubDivisionCurve( [
    Point3d( 15.5, 0, 0 ),
    Point3d( 16.5, 1, 0 ),
    Point3d( 17.5, 0, 0 ),
    Point3d( 18.5,-1, 0 ),
    Point3d( 19.5, 0, 0 )], weight )

geometry.append( curve.Approximate( count ).ToPolyline( ) )

curve = SubDivisionCurve( [
    Point3d( 15.5, 3, 0 ),
    Point3d( 16.5, 4, 0 ),
    Point3d( 17.5, 3, 0 ),
    Point3d( 16.5, 2, 0 ),
    Point3d( 15.5, 3, 0 )], weight )

geometry.append( curve.Approximate( count ).ToPolyline( ) )
# ---------- end subd ----------
bspline = GhPythonScript(t=number_slider)  # -> messages, geometry
# ---------- bspline: Python ----------
from Rhino.Geometry import *
import math

class BasisSplineCurve:
    """ Construction
    """
    def __init__( self, points, degree ):
        self.Points = points
        self.Degree = degree
        self.Knots  = self.ClampedKnots( )

    """ Normalized Open Knot Vector
    """
    def OpenKnots( self ):
        n, d = len( self.Points ), self.Degree
        return [index / ( n + d )
            for index in range( n + d + 1 )]

    """ Normalized Clamped Knot Vector
    """
    def ClampedKnots( self ):
        n, d = len( self.Points ), self.Degree
        kmin = [0.0] * d
        kmid = [i / ( n - d ) for i in range( n - d + 1 )]  
        kmax = [1.0] * d 
        return kmin + kmid + kmax

    """ Locate Knot Span Linear Search
    """
    def KnotSpan( self, t ):
        n, d = len( self.Points ), self.Degree
        if( t <= self.Knots[d] ): return d, d
        if( t >= self.Knots[n] ): return d, n - 1
        for knot, ( k_min, k_max ) in enumerate(
                zip( self.Knots[:-1], self.Knots[1:] ) ):
            if( k_min <= t <  k_max or
                k_min <  t <= k_max ):
                return d, knot

    """ De Boor's Algorithm
    """
    def Evaluate( self, t ):
        d, k = self.KnotSpan( t )
        P = self.Points[k-d:k+1]
        for i in range( d ):            
            for j in range( d, i, -1 ):
                to = self.Knots[j + k - d]
                ti = self.Knots[j + k - i]
                alpha = ( t - to ) / ( ti - to )
                P[j] = ( 1.0 - alpha ) * P[j - 1] + alpha * P[j]
        return P[-1]

    def Derive( self ):
        d = self.Degree
        points = []
        for i in range( 1, len( self.Points ) ):
            po, ko = self.Points[i-1], self.Knots[i  ]  
            pi, ki = self.Points[i  ], self.Knots[i+d]
            points.append( ( pi - po ) * d / ( ki - ko ) )
        curve = BasisSplineCurve( points, d - 1 )
        curve.Knots = self.Knots[1:-1]
        return curve

    def Derivatives( self, t, n = -1 ):
        d = self.Degree
        if( n < 0 or
            n > d ): 
            n = d
        curve = self
        delta = [curve.Evaluate( t )] * ( n + 1 )
        for k in range( 1, n + 1 ):
            curve = curve.Derive( )
            delta[k] = curve.Evaluate( t )
        return delta

    def Tangent( self, t ):
        _, u = self.Derivatives( t, 1 )
        u.Unitize( )
        return u

    def Normal( self, t ):
        _, u, v = self.Derivatives( t, 2 )
        n = Vector3d.CrossProduct( u, v )
        n.Unitize( )
        return n

    def Frame( self, t ):
        o, u, v = self.Derivatives( t, 2 )
        return Plane( o, u, v )
    
    def Curvature( self, t ):
        _, u, v = self.Derivatives( t, 2 )
        return Vector3d.CrossProduct( u, v ).Length / u.Length ** 3

    def Torsion( self, t ):
        o, u, v, w = self.Derivatives( t, 3 )
        x = Vector3d.CrossProduct( u, v )
        return ( x * w ) / ( x * x )

geometry = []

""" BSpline Demo
"""
controls = [
    Point3d(  6.0, 0.0, 0.0 ),
    Point3d(  7.0, 1.0, 0.0 ),
    Point3d(  8.0, 0.0, 1.0 ),
    Point3d(  9.0,-1.0, 0.0 ),
    Point3d( 10.0, 0.0, 0.0 )]

degree = 3
bspline = BasisSplineCurve( controls, degree )
print( 'BSpline Knots {}'.format( bspline.Knots ) )
geometry.append( Circle( bspline.Evaluate( t ), 0.1 ) )
geometry.append( bspline.Frame( t ) )

print( 'k = {}'.format( bspline.Curvature( t ) ) )
print( 't = {}'.format( bspline.Torsion( t ) ) )

#-- Rhino Equivalent
#--
curve = NurbsCurve.Create(False, degree, controls )
curve.Knots.CreateUniformKnots( 2.0 / ( len( controls ) - 1 ) )
print( 'Rhinos Knots {}'.format( list( curve.Knots ) ) )
geometry.append( curve )
geometry.append( curve.PointAt( curve.Domain.ParameterAt( t ) ) )

p, u = curve.DerivativeAt( curve.Domain.ParameterAt( t ), 1 )
p = Point3d( p )
geometry.append( Line( p, u ) )
print( 'k = {}'.format( curve.CurvatureAt( t ).Length ) )
print( 't = {}'.format( curve.TorsionAt( t ) ) )
# ---------- end bspline ----------
bezier = GhPythonScript(t=number_slider)  # -> messages, geometry
# ---------- bezier: Python ----------
from Rhino.Geometry import *
import math

def math_comb( n, k ):
    return math.factorial( n ) // (
           math.factorial( k ) * math.factorial( n - k ) )

class BezierCurve:
    def __init__( self, points ):
        self.Points = points

    @property
    def Degree( self ):
        return len( self.Points ) - 1

    @staticmethod
    def DeCasteljau( points, t ):
        if( len( points ) == 1 ):
            return points[0]
        new_points = []
        for source, target in zip( points[:-1], points[1:] ):
            new_points.append( source * ( 1 - t ) + target * t )
        return BezierCurve.DeCasteljau( new_points, t )

    def Evaluate( self, t ):
        return BezierCurve.DeCasteljau( self.Points, t )
        
    def Derive( self ):
        d = self.Degree
        points = [( target - source ) * d
            for source, target in zip( 
                self.Points[:-1], self.Points[1:] )]
        return BezierCurve( points )

    def Derivatives( self, t, n = -1 ):
        d = self.Degree
        if( n < 0 or
            n > d ): 
            n = d
        curve = self
        delta = [curve.Evaluate( t )] * ( n + 1 )
        for k in range( 1, n + 1 ):
            curve = curve.Derive( )
            delta[k] = curve.Evaluate( t )
        return delta

    def Tangent( self, t ):
        _, u = self.Derivatives( t, 1 )
        u.Unitize( )
        return u

    def Normal( self, t ):
        _, u, v = self.Derivatives( t, 2 )
        n = Vector3d.CrossProduct( u, v )
        n.Unitize( )
        return n

    def Frame( self, t ):
        o, u, v = self.Derivatives( t, 2 )
        return Plane( o, u, v )
    
    def Curvature( self, t ):
        _, u, v = self.Derivatives( t, 2 )
        return Vector3d.CrossProduct( u, v ).Length / u.Length ** 3

    def Torsion( self, t ):
        o, u, v, w = self.Derivatives( t, 3 )
        x = Vector3d.CrossProduct( u, v )
        return ( x * w ) / ( x * x )

geometry = []

""" Bezier Demo
"""
controls = [
    Point3d( 0.0, 0.0, 0.0 ),
    Point3d( 1.0, 1.0, 0.0 ),
    Point3d( 2.0, 0.0, 1.0 ),
    Point3d( 3.0,-1.0, 0.0 ),
    Point3d( 4.0, 0.0, 0.0 )]
    
bezier = BezierCurve( controls )
geometry.append( Circle( bezier.Evaluate( t ), 0.1 ) )

geometry.append( bezier.Frame( t ) )

print( 'k = {}'.format( bezier.Curvature( t ) ) )
print( 't = {}'.format( bezier.Torsion( t ) ) )

#-- Rhino Equivalent
#--
periodic, degree = False, len( controls ) - 1
curve = NurbsCurve.Create( periodic, degree, controls )
geometry.append( curve )
geometry.append( curve.PointAt( t ) )
# ---------- end bezier ----------
nurbs = GhPythonScript(t=number_slider)  # -> messages, geometry
# ---------- nurbs: Python ----------
from Rhino.Geometry import *
import math

def math_comb( n, k ):
    return math.factorial( n ) // (
           math.factorial( k ) * math.factorial( n - k ) )

class BasisSplineCurve:
    """ Construction
    """
    def __init__( self, points, degree ):
        self.Points = points
        self.Degree = degree
        self.Knots  = self.ClampedKnots( )

    """ Normalized Open Knot Vector
    """
    def OpenKnots( self ):
        n, d = len( self.Points ), self.Degree
        return [index / ( n + d )
            for index in range( n + d + 1 )]

    """ Normalized Clamped Knot Vector
    """
    def ClampedKnots( self ):
        n, d = len( self.Points ), self.Degree
        kmin = [0.0] * d
        kmid = [i / ( n - d ) for i in range( n - d + 1 )]  
        kmax = [1.0] * d 
        return kmin + kmid + kmax

    """ Locate Knot Span Linear Search
    """
    def KnotSpan( self, t ):
        n, d = len( self.Points ), self.Degree
        if( t <= self.Knots[d] ): return d, d
        if( t >= self.Knots[n] ): return d, n - 1
        for knot, ( k_min, k_max ) in enumerate(
                zip( self.Knots[:-1], self.Knots[1:] ) ):
            if( k_min <= t <  k_max or
                k_min <  t <= k_max ):
                return d, knot
    
    """ De Boor's Algorithm
    """
    def Evaluate( self, t ):
        d, k = self.KnotSpan( t )
        P = self.Points[k-d:k+1]
        for i in range( d ):            
            for j in range( d, i, -1 ):
                to = self.Knots[j + k - d]
                ti = self.Knots[j + k - i]
                
                alpha = ( t - to ) / ( ti - to )
                omega = 1.0 - alpha
                
                P[j] = omega * P[j - 1] + alpha * P[j]
        return P[-1]

    def Derive( self ):
        d = self.Degree
        points = []
        for i in range( 1, len( self.Points ) ):
            po, ko = self.Points[i-1], self.Knots[i  ]  
            pi, ki = self.Points[i  ], self.Knots[i+d]
            points.append( ( pi - po ) * d / ( ki - ko ) )
        curve = BasisSplineCurve( points, d - 1 )
        curve.Knots = self.Knots[1:-1]
        return curve

    def Derivatives( self, t, n = -1 ):
        d = self.Degree
        if( n < 0 or
            n > d ): 
            n = d
        curve = self
        delta = [curve.Evaluate( t )] * ( n + 1 )
        for k in range( 1, n + 1 ):
            curve = curve.Derive( )
            delta[k] = curve.Evaluate( t )
        return delta

    def Tangent( self, t ):
        _, u = self.Derivatives( t, 1 )
        u.Unitize( )
        return u

    def Normal( self, t ):
        _, u, v = self.Derivatives( t, 2 )
        n = Vector3d.CrossProduct( u, v )
        n.Unitize( )
        return n

    def Frame( self, t ):
        o, u, v = self.Derivatives( t, 2 )
        return Plane( Point3d( o ), u, v )
    
    def Curvature( self, t ):
        _, u, v = self.Derivatives( t, 2 )
        return Vector3d.CrossProduct( u, v ).Length / u.Length ** 3

    def Torsion( self, t ):
        o, u, v, w = self.Derivatives( t, 3 )
        x = Vector3d.CrossProduct( u, v )
        return ( x * w ) / ( x * x )

class RationalBSplineCurve( BasisSplineCurve ):
    """ Construction
    """
    def __init__( self, points, degree ):
        BasisSplineCurve.__init__( self, points, degree )

    @staticmethod
    def Circle( origin, radius ):
        r, w, o = 1.0, 0.5 * math.sqrt( 2.0 ), origin
        controls = [Point4d( o.X + r, o.Y + 0, o.Z, 1 ), 
                    Point4d( o.X + r, o.Y + r, o.Z, w ), 
                    Point4d( o.X + 0, o.Y + r, o.Z, 1 ), 
                    Point4d( o.X - r, o.Y + r, o.Z, w ), 
                    
                    Point4d( o.X - r, o.Y + 0, o.Z, 1 ), 
                    Point4d( o.X - r, o.Y - r, o.Z, w ), 
                    Point4d( o.X + 0, o.Y - r, o.Z, 1 ), 
                    Point4d( o.X + r, o.Y - r, o.Z, w ),
                    Point4d( o.X + r, o.Y + 0, o.Z, 1 )]
        curve = RationalBSplineCurve( controls, 2 )
        curve.Knots = [0.00, 0.00, 0.00, 
                       0.25, 0.25, 0.50, 
                       0.50, 0.75, 0.75, 
                       1.00, 1.00, 1.00]    
        return curve

    def Decouple( self, points ):
        P = [Point3d( p.X * p.W, 
                      p.Y * p.W, 
                      p.Z * p.W ) 
                 for p in points]
        W = [p.W for p in points]
        return P, W

    def Evaluate( self, t ):
        d, k = self.KnotSpan( t )
        P, W = self.Decouple( self.Points[k-d:k+1] )
        K = self.Knots[k-d:k+d+1]
        
        A = BasisSplineCurve( P, d ); A.Knots = K
        w = BasisSplineCurve( W, d ); w.Knots = K
        
        return A.Evaluate( t ) / w.Evaluate( t )
#        for i in range( d ):            
#            for j in range( d, i, -1 ):
#                to = self.Knots[j + k - d]
#                ti = self.Knots[j + k - i]
#                
#                alpha = ( t - to ) / ( ti - to )
#                omega = 1.0 - alpha
#                
#                P[j] = omega * P[j - 1] + alpha * P[j]
#                W[j] = omega * W[j - 1] + alpha * W[j]
#                
#        return P[d] / W[d]

    def Derivatives( self, t, n = -1 ):
        d = self.Degree
        if( n < 0 or 
            n > d ): 
            n = d
        
        """ Non-Rational Derivatives
        """
        P, W = self.Decouple( self.Points )
        A = BasisSplineCurve( P, d ); A.Knots = self.Knots
        w = BasisSplineCurve( W, d ); w.Knots = self.Knots
        
        dA = A.Derivatives( t, n )
        dw = w.Derivatives( t, n )

        """ Rational Derivatives
        """
        D = [1.0] * ( n + 1 )
        for k in range( n + 1 ):
            u = Vector3d( dA[k] )
            for i in range( 1, k + 1 ):
                u -= math_comb( k, i ) * dw[i] * D[k - i]
            D[k] = u / dw[0]
        return D

geometry = []

controls = [
    Point4d( 11.0, 0.0, 0.0, 1.0 ),
    Point4d( 12.0, 1.0, 0.0, 5.0 ), #-- Rational
    Point4d( 13.0, 0.0, 1.0, 1.0 ),
    Point4d( 14.0,-1.0, 0.0, 5.0 ), #-- Rational
    Point4d( 15.0, 0.0, 0.0, 1.0 )]
    
nurbs = RationalBSplineCurve( controls, 3 )    

geometry.append( Circle( nurbs.Evaluate( t ), 0.1 ) )
geometry.append( nurbs.Frame( t ) )

print( 'Knots {}'.format( list( nurbs.Knots ) ) )
print( 'k = {}'.format( nurbs.Curvature( t ) ) )
print( 't = {}'.format( nurbs.Torsion( t ) ) )

n = 32
geometry.append( PolylineCurve( [
    nurbs.Evaluate( i / ( n - 1 ) ) 
        for i in range( n )] ) )
        
curve = NurbsCurve( 3, True, 4, len( controls ) )
for index in range( len( controls ) ):
    curve.Points.SetPoint( index, 
        Point3d( controls[index].X, 
                 controls[index].Y, 
                 controls[index].Z ),
                 controls[index].W )
curve.Knots.CreateUniformKnots( 2.0 / ( len( controls ) - 1 ) )
print( 'Knots {}'.format( list( curve.Knots ) ) )
geometry.append( curve )
geometry.append( curve.PointAt( curve.Domain.ParameterAt( t ) ) )


p, u = curve.DerivativeAt( curve.Domain.ParameterAt( t ), 1 )
p = Point3d( p )
geometry.append( Line( p, u ) )
print( 'k = {}'.format( curve.CurvatureAt( t ).Length ) )
print( 't = {}'.format( curve.TorsionAt( t ) ) )


origin = Point3d( 13.0, 3.0, 0.0 )
nurbs = RationalBSplineCurve.Circle( origin, 1.0 )
n = 32
geometry.append( PolylineCurve( [
    nurbs.Evaluate( i / ( n - 1 ) ) 
        for i in range( n )] ) )

point = nurbs.Evaluate( t )
geometry.append( Circle( point, 0.1 ) )
# ---------- end nurbs ----------
panel = Panel(bezier.messages)
panel_2 = Panel(bspline.messages)
panel_3 = Panel(nurbs.messages)
