# Grasshopper definition cpython.gh (Grasshopper 1.0.7)

point = Point(Point(1, 0, 0))
point_2 = Point(Point(0, 0, 0))
panel = Panel("Hello World")
pythonpath = FilePath()
merge = Merge(Data1=point_2, Data2=point)  # -> flatten(Result)
curve = Curve(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)
ipy = GhPythonScript(Points=merge)  # -> Messages, Context; inputs Points: list of Point3d
# ---------- ipy: Python ----------
""" Point Average using NumPy
"""
def PointAverage( points ):
    import numpy as np
    mean = np.mean( np.array( points ), axis = 0 )
    return mean.tolist( )

""" Points to Coordinate Lists
"""
def ToNumPy( points ):
    return [[point.X, point.Y, point.Z]
        for point in points]

""" Coordinate List to Point
"""
def ToRhino( point ):
    from Rhino.Geometry import Point3d
    return Point3d( point[0], point[1], point[2] )

Context = [ ghenv, PointAverage, ToNumPy( Points ), ToRhino]
# ---------- end ipy ----------
ipy_2 = GhPythonScript(spline=curve)  # -> Messages, Context; inputs spline: Curve
# ---------- ipy_2: Python ----------
""" Load Curve from Json Data
"""
def Exchange( data ):
    import json
    from rhino3dm import Curve
    curve = Curve.Decode( json.loads( data ) )
    parts = curve.Split( 0.5 )
    return [json.dumps( part.Encode( ) ) 
        for part in parts]

""" Encode Curve to Json Data
"""
def Encode( curve ):
    return curve.ToJSON( None )

""" Load Curves from Json Data
"""
def Decode( data ):
    from Rhino.Runtime import CommonObject
    parts = [CommonObject.FromJSON( item )
        for item in data]
    return parts

Context = ( ghenv, Exchange, Encode( spline ), Decode )
# ---------- end ipy_2 ----------
ipy_3 = GhPythonScript()  # -> Messages, Context
# ---------- ipy_3: Python ----------
""" CPython Code
"""
def PythonCode( params ):
    import sys
    return params + '\n<<--- Python ' + sys.version

""" IronPython -> CPython Parameter Conversion
"""
def PythonParams( params ):
    import sys
    if( params is not None ):
        return params + '\n--->> Python ' + sys.version
    else:
        return '--->> Python ' + sys.version

""" CPython -> IronPython Result Conversion
"""
def PythonResult( params ):
    import sys
    return params + '\n--->> Python ' + sys.version

Context = ( ghenv,          #-- Required 
    PythonCode,             #-- Required
    PythonParams( Input ),  #-- Optional
    PythonResult )          #-- Optional
# ---------- end ipy_3 ----------
cpy = GhPythonScript(Context=ipy_2.Context)  # -> Messages, Status, Result; inputs Context: list, Debug: Boolean
# ---------- cpy: Python ----------
import os, sys, json, traceback, ast

def InvokePython( context, method, params, callback ):
    """ Extract Source Code
    """
    try:
        source, target = -1, -1
        code = context.Component.Code.replace( '\r\n', '\n' )
        module = ast.parse( code )
        ast.fix_missing_locations( module )
        for node in ast.walk( module ):
            if( source < 0 ):
                if( 'Function' in str( type( node ) ) ):
                    if( node.name == method.__name__ ):
                       source = node.lineno - 1
            else:
                target = node.lineno - 1
                break
        lines = code.strip( ).split( '\n' )
        code = '\n'.join( lines[source:target] ).strip( )    
        if( Debug ): print( '#-- Code\n{}'.format( code ) )
    except:
        print( 'Failed loading the cpython function.' )
        print( traceback.format_exc( ) )
        return False, None

    """ Serialize Parameters
    """
    try:
        if( params is not None ):
            params = json.dumps( params )
        else:
            params = []
        if( Debug ): print( '#-- Params\n{}'.format( params ) )
    except:
        print( 'Failed serializing parameters.' )
        print( traceback.format_exc( ) )
        return False, None

    """ Complete Script
    """
    desktop = os.path.join( os.path.join( 
        os.path.expanduser( '~' ) ), 'Desktop' )
    target = os.path.join( desktop, 'target.json' )

    code += '\n'.join( ['',
        'params = ' + params,
        'result = {}( params )'.format( method.__name__ ),
        'import json',
        'target = r"{}"'.format( target ), 
        'with open( target, \'w\' ) as stream:',
        '  stream.write( json.dumps( result ) )'] )
    if( Debug ): print( '#-- Target\n{}'.format( target ) )
    if( Debug ): print( '#-- Method\n{}( )'.format( method.__name__ ) )
    
    """ Write Script to Desktop
    """
    try:
        source = os.path.join( desktop, 'source.py'   )
        with open( source, 'w' ) as stream:
            stream.write( code )
        if( Debug ): print( '#-- Source\n{}'.format( source ) )
    except:
        print( 'Failed writing python script file.' )
        print( traceback.format_exc( ) )
        return False, None

    """ Invoke CPython Interpreter
    """
    try:
        if( Python is not None ):
            python = Python
        else:
            python = 'python'
        command = '{} "{}"'.format( python, source )
        if( Debug ): print( '#-- Command\n{}'.format( command ) )
        import subprocess
        info = subprocess.STARTUPINFO( )
        info.dwFlags |= subprocess.STARTF_USESHOWWINDOW
        result = subprocess.check_output( command, 
            startupinfo = info, stderr=subprocess.STDOUT )
        if( not Debug ): os.remove( source )        
    except subprocess.CalledProcessError as exc:
        print( exc.output )
        return False, None
    except:
        print( 'Failed executing python script.' )
        print( traceback.format_exc( ) )
        return False, None

    """ Load Result Data from Json
    """
    try:
        with open( target ) as stream:
            data = stream.read( )      
        if( Debug ): print( '#-- Result\n{}'.format( data ) )            
    except:
        print( 'Failed loading result data.' )
        print( traceback.format_exc( ) )
        return False, None

    """ Parse Result from Json Data
    """
    try:
        result = json.loads( data )
        if( not Debug ): os.remove( target )        
    except:
        print( 'Failed parsing json result data.' )
        print( traceback.format_exc( ) ) 
        return False, None

    """ Convert Data to IronPython
    """
    try:
        if( callback is not None ):
            result = callback( result )
    except:
        print( 'Failed decoding the result data.' )
        print( traceback.format_exc( ) )

    print( '#-- Success' )
    return True, result

Status, Result = InvokePython( *Context )
# ---------- end cpy ----------
cpy_2 = GhPythonScript(Context=ipy.Context)  # -> Messages, Status, Result; inputs Context: list, Debug: Boolean; same code as cpy
cpy_3 = GhPythonScript(Context=ipy_3.Context)  # -> Messages, Status, Result; inputs Context: list, Debug: Boolean; same code as cpy
panel_2 = Panel(cpy.Messages)
panel_3 = Panel(cpy_3.Result)
panel_4 = Panel(cpy_2.Messages)
panel_5 = Panel(cpy.Result)
panel_6 = Panel(cpy_2.Result)
panel_7 = Panel(cpy_3.Messages)
