# Grasshopper definition loops.gh (Grasshopper 1.0.7)

trigger = Trigger(Interval=50, TimerInterval=50, Target=load)  # disabled
trigger_2 = Trigger(Interval=50, TimerInterval=50, Target=load_2)  # disabled
trigger_3 = Trigger(Interval=1000, TimerInterval=1000, Target=load_3)  # disabled
trigger_4 = Trigger(Interval=100, TimerInterval=100, Target=load_5)  # disabled
trigger_5 = Trigger(Interval=1000, TimerInterval=1000, Target=load_4)  # disabled
boolean_toggle = BooleanToggle(True)
load = GhPythonScript(Reset=Button())  # -> Engine, Current; inputs Reset: Boolean
# ---------- load: Python ----------
Engine = ghenv.Engine

class Static:
    def __init__( self, 
             state = 'Initialize', 
             value = None,
             cycle = 0 ):
        self.Cycle = cycle
        self.State = state
        self.Value = value

    def Update( self, state, value ):
        return Static( state, value, self.Cycle + 1 )
        
    def __repr__( self ):
        return 'Cycle: {}\nState: {}\nValue: {}'.format( self.Cycle, self.State, self.Value )

if( Reset ):
    Current = Static( )
    Engine.Runtime.Globals.SetVariable( '__Data__', Current );
else:
    Current = Engine.Runtime.Globals.GetVariable( '__Data__' )
# ---------- end load ----------
load_2 = GhPythonScript(Reset=Button())  # -> Iteration, State, Values; inputs Reset: Boolean; disabled
# ---------- load_2: Python ----------
import Rhino, json

if( Reset ):
    Rhino.RhinoDoc.ActiveDoc.Notes = ''
    Iteration = 0
    State     = 'Initialize'
    Values    = []
else:
    data = json.loads( Rhino.RhinoDoc.ActiveDoc.Notes )
    Iteration = data['Iteration']
    State     = data['State']
    Values    = data['Values']
# ---------- end load_2 ----------
load_3 = GhPythonScript(Reset=Button())  # -> Iteration, State, Values; inputs Reset: Boolean; disabled; same code as load_2
load_4 = GhPythonScript(Default="0", Reset=Button())  # -> Iteration, TickCount; inputs Default: Int32, Reset: Boolean; disabled
# ---------- load_4: Python ----------
import Rhino, json

if( Reset ):
    Rhino.RhinoDoc.ActiveDoc.Notes = ''
    Iteration = 0
    TickCount = Default
else:
    data = json.loads( Rhino.RhinoDoc.ActiveDoc.Notes )
    Iteration = data['Iteration']
    TickCount = data['TickCount']
# ---------- end load_4 ----------
load_5 = GhPythonScript(Reset=Button())  # -> Iteration; inputs Reset: Boolean; disabled
# ---------- load_5: Python ----------
import Rhino, json

if( Reset ):
    Rhino.RhinoDoc.ActiveDoc.Notes = ''
    Iteration = 0
else:
    data = json.loads( Rhino.RhinoDoc.ActiveDoc.Notes )
    Iteration = data['Iteration']
# ---------- end load_5 ----------
surface = Surface(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)
surface_2 = Surface(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)
panel = Panel(load_5)
clock = GhPythonScript(ThisTick=load_4.TickCount)  # -> NextTick, Handle; inputs ThisTick: Int32
# ---------- clock: Python ----------
from Rhino.Geometry import Point3d, Circle, Line

circle = Circle( Point3d.Origin, 1.0 )
angle  = ( ThisTick / 60 ) * ( 2.0 * 3.1415 )
Handle = Line( Point3d.Origin, circle.PointAt( angle ) )

NextTick = ( ThisTick + 1 ) % 60
# ---------- end clock ----------
fsm = GhPythonScript(State=load_3.State, Values=load_3.Values)  # -> NewState, NewValues; inputs Values: list
# ---------- fsm: Python ----------
if( State == 'Initialize' ):
    NewValues = [0.0]
    NewState  = 'Phase One'
    
elif( State == 'Phase One' ):
    NewValues = [value + 1 for value in Values]
    NewState  = 'Phase Two'
    
elif( State == 'Phase Two' ):
    NewValues = [value * 2 for value in Values]
    NewState = 'Phase One'
    
else:
    raise Exception( 'Unknown State' )
# ---------- end fsm ----------
gd = GhPythonScript(Current=load.Current, Landscape=surface)  # -> Updated, Geometry; inputs Landscape: Surface
# ---------- gd: Python ----------
from Rhino.Geometry import Vector3d, Sphere, PolylineCurve

if( Current.State == 'Initialize' ):
    Updated = Current.Update( 
        state = 'Follow Gradient', 
        value = {
            'Params': [0.0, 0.0],
            'Points': [] 
        } )
    Geometry = []

elif( Current.State == 'Follow Gradient' ):
    
    u, v = Current.Value['Params']
    path = Current.Value['Points']
    
    p = Landscape.PointAt( u, v )
    n = Landscape.NormalAt( u, v )
    Z = Vector3d.ZAxis
    g = Vector3d.CrossProduct( Vector3d.CrossProduct( Z, n ), Z )
    q = p + g * 0.05
    _, u, v = Landscape.ClosestPoint( q )
    
    Updated = Current.Update( 
        state = Current.State,
        value = {
            'Params': [u, v],
            'Points': path + [p]
        } )
   
    Geometry = []
    Geometry.append( Sphere( p + n * 0.1, 0.1 ) )
    if( len( path ) > 2 ):
        Geometry.append( PolylineCurve( path ) )

else:
    raise Exception( 'Unknown State' )
# ---------- end gd ----------
gd_2 = GhPythonScript(State=load_2.State, Values=load_2.Values, Landscape=surface_2)  # -> NewState, NewValues, Geometry; inputs Values: list, Landscape: Surface
# ---------- gd_2: Python ----------
from Rhino.Geometry import Vector3d, Sphere

if( State == 'Initialize' ):
    Geometry  = []
    NewValues = [0.0, 0.0]
    NewState  = 'Follow Gradient'
    
elif( State == 'Follow Gradient' ):
    u, v = Values
    
    p = Landscape.PointAt( u, v )
    n = Landscape.NormalAt( u, v )
    Z = Vector3d.ZAxis
    g = Vector3d.CrossProduct( Vector3d.CrossProduct( Z, n ), Z )
    q = p + g * 0.05
    _, u, v = Landscape.ClosestPoint( q )
    Geometry = [Sphere( p + n * 0.1, 0.1 )]
    
    NewValues = [u, v]
    NewState  = State
    
else:
    raise Exception( 'Unknown State' )
# ---------- end gd_2 ----------
save = GhPythonScript(Iteration=load_5, Result=panel)  # -> Log; inputs Iteration: Int32
# ---------- save: Python ----------
import json, Rhino

data = {
    'Iteration': Iteration + 1,
}

Rhino.RhinoDoc.ActiveDoc.Notes = json.dumps( data )
# ---------- end save ----------
save_2 = GhPythonScript(Iteration=load_4.Iteration, TickCount=clock.NextTick)  # -> Log; inputs Iteration: Int32
# ---------- save_2: Python ----------
import json, Rhino

data = {
    'Iteration': Iteration + 1,
    'TickCount': TickCount
}

Rhino.RhinoDoc.ActiveDoc.Notes = json.dumps( data )
# ---------- end save_2 ----------
save_3 = GhPythonScript(Iteration=load_3.Iteration, State=fsm.NewState, Values=fsm.NewValues)  # -> Log; inputs Iteration: Int32, Values: list
# ---------- save_3: Python ----------
import json, Rhino

data = {
    'Iteration': Iteration + 1,
    'State':     State,
    'Values':    Values
}

Rhino.RhinoDoc.ActiveDoc.Notes = json.dumps( data )
# ---------- end save_3 ----------
save_4 = GhPythonScript(Engine=load.Engine, Updated=gd.Updated)  # -> Log
# ---------- save_4: Python ----------
Engine.Runtime.Globals.SetVariable( '__Data__', Updated )

limited = str( Updated )
if( len( limited ) > 512 ):
    limited = limited[:512]
print( limited )
# ---------- end save_4 ----------
save_5 = GhPythonScript(Iteration=load_2.Iteration, State=gd_2.NewState, Values=gd_2.NewValues)  # -> Log; inputs Iteration: Int32, Values: list; same code as save_3
