# Grasshopper definition template.gh (Grasshopper 1.0.7)

points = Point([Point(5.545425759, 8.193380175, 0), Point(12.91668771, 8.193380175, 0)])
point = Point([Point(5.740690976, 15.61345843, 0), Point(12.72142249, 15.61345843, 0)])
point_2 = Point([Point(5.740690976, 11.56170517, 0), Point(12.96550401, 11.56170517, 0)])
point_3 = Point([Point(5.154895325, 19.03059973, 0), Point(12.7702388, 19.03059973, 0)])

# ---- group: Component with geometry and annotations
ipy = GhPythonScript(points=point)  # -> messages, annotations, geometry; inputs points: list of Point3d
# ---------- ipy: Python ----------
import math, random
from Rhino import RhinoApp, RhinoDoc
from Rhino.Geometry import ( Point3d, Vector3d, Plane, Transform,
    Interval, Point2d, Point3f, Vector3f, Point2f, Line, Circle, Curve,
    Surface, NurbsCurve, NurbsSurface, Brep, Mesh,  Arc, ArcCurve, 
    BezierCurve, Box, Cone, ControlPoint, Cylinder, Ellipse, Extrusion, 
    LineCurve, LoftType, Point4d, PointCloud, PolyCurve, Polyline, 
    PolylineCurve, Quaternion, Sphere )
from Rhino.Geometry.Intersect import Intersection
from System.Drawing import Color

geometry = []
def Add( element ):
    geometry.append( element )

annotations = []
def Anno( point, label ):
    annotations.append( [point, label] )

''' Script Below
'''
source, target = points

Anno( source, 's' )
Anno( target, 't' )

Add( Line( source, target ) )
# ---------- end ipy ----------

# ---- group: Component with geometry, vectors and annotations
ipy_2 = GhPythonScript(points=points)  # -> messages, vectors, annotations, geometry; inputs points: list of Point3d
# ---------- ipy_2: Python ----------
import math, random
from Rhino import RhinoApp, RhinoDoc
from Rhino.Geometry import ( Point3d, Vector3d, Plane, Transform,
    Interval, Point2d, Point3f, Vector3f, Point2f, Line, Circle, Curve,
    Surface, NurbsCurve, NurbsSurface, Brep, Mesh,  Arc, ArcCurve, 
    BezierCurve, Box, Cone, ControlPoint, Cylinder, Ellipse, Extrusion, 
    LineCurve, LoftType, Point4d, PointCloud, PolyCurve, Polyline, 
    PolylineCurve, Quaternion, Sphere )
from Rhino.Geometry.Intersect import Intersection
from System.Drawing import Color

geometry = []
def Add( element ):
    geometry.append( element )

vectors = []
def Vec( point, direction, color = Color.Black ):
    vectors.append( [point, direction, color] )

annotations = []
def Anno( point, label ):
    annotations.append( [point, label] )

''' Script Below
'''
source, target = points

Anno( source, 's' )
Anno( target, 't' )

Add( ( source + target ) / 2 )

Vec( source, target - source, Color.Blue )
# ---------- end ipy_2 ----------

# ---- group: Component with geometry and vectors
ipy_3 = GhPythonScript(points=point_2)  # -> messages, vectors, geometry; inputs points: list of Point3d
# ---------- ipy_3: Python ----------
import math, random
from Rhino import RhinoApp, RhinoDoc
from Rhino.Geometry import ( Point3d, Vector3d, Plane, Transform,
    Interval, Point2d, Point3f, Vector3f, Point2f, Line, Circle, Curve,
    Surface, NurbsCurve, NurbsSurface, Brep, Mesh,  Arc, ArcCurve, 
    BezierCurve, Box, Cone, ControlPoint, Cylinder, Ellipse, Extrusion, 
    LineCurve, LoftType, Point4d, PointCloud, PolyCurve, Polyline, 
    PolylineCurve, Quaternion, Sphere )
from Rhino.Geometry.Intersect import Intersection
from System.Drawing import Color

geometry = []
def Add( element ):
    geometry.append( element )

vectors = []
def Vec( point, direction, color = Color.Black ):
    vectors.append( [point, direction, color] )

''' Script Below
'''
source, target = points
Vec( source, target - source, Color.Blue )
Add( Line( source, target ) )
# ---------- end ipy_3 ----------

# ---- group: Component with geometry
ipy_4 = GhPythonScript(points=point_3)  # -> messages, geometry; inputs points: list of Point3d
# ---------- ipy_4: Python ----------
import math, random
from Rhino import RhinoApp, RhinoDoc
from Rhino.Geometry import ( Point3d, Vector3d, Plane, Transform,
    Interval, Point2d, Point3f, Vector3f, Point2f, Line, Circle, Curve,
    Surface, NurbsCurve, NurbsSurface, Brep, Mesh,  Arc, ArcCurve, 
    BezierCurve, Box, Cone, ControlPoint, Cylinder, Ellipse, Extrusion, 
    LineCurve, LoftType, Point4d, PointCloud, PolyCurve, Polyline, 
    PolylineCurve, Quaternion, Sphere )
from Rhino.Geometry.Intersect import Intersection
from System.Drawing import Color

geometry = []
def Add( element ):
    geometry.append( element )

''' Script Below
'''
source, target = points
Add( ( source + target ) / 2 )
# ---------- end ipy_4 ----------

# ----
anno = Anno(annotations=ipy.annotations, size=Slider(1, range=0..1))
cluster = Cluster(vectors=ipy_2.vectors, annotations=ipy_2.annotations, size=Slider(1, range=0..1))
vecs = Vecs(vectors=ipy_3.vectors)

# ==== cluster Vecs
vectors = ClusterInput()
py = GhPythonScript(vectors=vectors)  # -> points, directions, colors; inputs vectors: list
# ---------- py: Python ----------
points     = []
directions = []
colors     = []

for point, direction, color in vectors:
    points     .append( point     )
    directions .append( direction )
    colors     .append( color     )
# ---------- end py ----------
vector_display_ex = VectorDisplayEx(Point=py.points, Vector=py.directions, Colour=py.colors, Width=2)

# ==== cluster Anno
annotations = ClusterInput()
anno = GhPythonScript(annotations=annotations)  # -> points, labels; inputs annotations: list
# ---------- anno: Python ----------
points = []
labels = []
for point, label in annotations:
    points.append( point )
    labels.append( label )
# ---------- end anno ----------
size = ClusterInput()
text_tag_3d = TextTag3D(Location=anno.points, Text=anno.labels, Size=size, Justification=7)

# ==== cluster Cluster
annotations = ClusterInput()
vectors = ClusterInput()
size = ClusterInput()
anno = GhPythonScript(annotations=annotations)  # -> points, labels; inputs annotations: list; same code as anno
py = GhPythonScript(vectors=vectors)  # -> points, directions, colors; inputs vectors: list; same code as py
text_tag_3d = TextTag3D(Location=anno.points, Text=anno.labels, Size=size, Justification=7)
vector_display_ex = VectorDisplayEx(Point=py.points, Vector=py.directions, Colour=py.colors, Width=2)
