# Grasshopper definition StdLib3DP.gh (Grasshopper 1.0.8)
# plug-ins: stdlib

# ---- group: Base Geometry
# Geometric Modeling
circle = Circle(Plane=PlaneXY(0, 0, 0), Radius=Slider(50, range=0..50))

# ---- group: Segmentation
length = Length(Curve=circle)
division = Division(A=length, B=Slider(5, range=1..10))
divide_curve = DivideCurve(Curve=circle, Count=division, Kinks=False)  # -> Points, Tangents, Parameters
polyline = PolyLine(Vertices=divide_curve.Points, Closed=False)

# ---- group: Build Layers
series = Series(Start=0, Step=1, Count=Slider(10, range=1..10))
multiplication = Multiplication(A=Slider(5, range=1..10), B=series)
unit_z = UnitZ(Factor=multiplication)
move = Move(Geometry=polyline, Motion=unit_z)  # -> Geometry, Transform

# ---- group: Calibration and Plane Sequencing
flange = Plane(Plane(origin=(533, 0, 889.1), x=(0, 0, -1), y=(0, 1, 0)))
point_a = Point(Point(739.6210568, -11.25365906, 587.6820267))
point_b = Point(Point(739.6210568, 222.942548, 587.6820267))
point_c = Point(Point(498.3139314, -11.25365906, 587.6820267))
plane_3pt = Plane3Pt(PointA=point_a, PointB=point_b, PointC=point_c)
vector_xyz = VectorXYZ(XComponent=Slider(0, range=-100..100), YComponent=Slider(0, range=-100..100), ZComponent=Slider(3, range=-100..100))  # -> Vector, Length
move_2 = Move(Geometry=move.Geometry, Motion=vector_xyz.Vector)  # -> Geometry, Transform
orient = Orient(Geometry=move_2.Geometry, Source=PlaneXY(0, 0, 0), Target=plane_3pt)  # -> Geometry, Transform
control_polygon = ControlPolygon(Curve=orient.Geometry)  # -> Polygon, flatten(Points)
plane_origin = PlaneOrigin(Base=flange, Origin=control_polygon.Points)

# ---- group: Check Minimum Distance
explode = Explode(Curve=polyline, Recursive=True)  # -> Segments, Vertices
length_2 = Length(Curve=explode.Segments)
bounds = Bounds(Numbers=length_2)
panel = Panel(bounds)

# ---- group: Kinematics & Geometric Model Definition
# Motion Planning
model_robot = ModelRobot(Configuration="IRB1205", Page=0, Paged=False, Range=0)  # -> Robot, Ranges

# ---- group: Start Extruder
integer = Integer("1")
robot_task = RobotTask(
    Position_Velocity="50",
    Rotation_Velocity="500",
    Blend_Radius="1",
    Control=0,
    Modify=0,
    Motion=0,
    Page=2,
    Paged=True,
    Signals=0,
    Syntax=0)
robot_task_2 = RobotTask(Robot="DO15", Value=integer, Control=0, Modify=0, Motion=0, Page=1, Paged=True, Signals=1, Syntax=0)
robot_task_3 = RobotTask(Robot="1", Control=1, Modify=0, Motion=0, Page=2, Paged=True, Signals=1, Syntax=0)
merge = Merge(Data1=robot_task, Data2=robot_task_2, Data3=robot_task_3)
robot_task_4 = RobotTask(Operations=merge, Control=0, Modify=2, Motion=0, Page=4, Paged=True, Signals=0, Syntax=0)

# ---- group: Stop Extruder
robot_task_5 = RobotTask(Robot="DO15", Control=0, Modify=0, Motion=0, Page=1, Paged=True, Signals=0, Syntax=0)
robot_task_6 = RobotTask(Robot="1", Control=1, Modify=0, Motion=0, Page=2, Paged=True, Signals=1, Syntax=0)
merge_2 = Merge(Data1=robot_task_6, Data2=robot_task_5)
robot_task_7 = RobotTask(Operations=merge_2, Control=0, Modify=2, Motion=0, Page=4, Paged=True, Signals=0, Syntax=0)

# ----
pose_settings = PoseSettings(Basis=1, Elbow=1, Page=2, Paged=False, Wrist=0)
robot_task_8 = RobotTask(
    Robot=model_robot.Robot,
    Joints=plane_origin,
    Before=pose_settings,
    Before_2=robot_task_4,
    Every=robot_task_7,
    Control=0,
    Modify=0,
    Motion=2,
    Page=0,
    Paged=True,
    Signals=0,
    Syntax=0)  # -> flatten(Task)

# ---- group: Machine Code Compiler
machine_code = MachineCode(Tasks=robot_task_8, Compact=0, Datum=1, Digits=3, Page=3, Paged=False, Type=302)  # -> Code, Report
text_join = TextJoin(Text=machine_code.Code)

# ---- group: Program Uploader
file_transfer_request = FileTransferRequest(
    Host="192.168.125.1:21",
    Username="Student",
    Password="p a s s w o r d",
    Location="/Users/Students/stdlib.mod",
    Contents=text_join,
    Operation=1,
    Page=1,
    Paged=False,
    Protocol=0)  # disabled
panel_2 = Panel(file_transfer_request)

# ---- group: Simulation
# Simulation and Compilation
display_robot_motion = DisplayRobotMotion(Task=robot_task_8, Major=0, Minor=0)  # -> State, Target
display_robot_model = DisplayRobotModel(Robot=model_robot.Robot, State=display_robot_motion.State, Display=3, High=56, Low=7, Page=0, Paged=False, Tool=192)
