# Grasshopper definition StdLibComs.gh (Grasshopper 1.0.8)
# plug-ins: stdlib

model_robot = ModelRobot(Configuration="IRB1205", Page=0, Paged=False, Range=0)  # -> Robot, Ranges
robot_communications = RobotCommunications(Location="192.168.125.1:5515", Interval="500", Page=0, Paged=False, Robot=0)  # -> Joints, Inputs, Outputs, Messages, Geometry
panel = Panel(robot_communications.Messages)
forward_kinematics = ForwardKinematics(Robot=model_robot.Robot, Joints=robot_communications.Joints)  # -> State, Planes
display_robot_model = DisplayRobotModel(Robot=model_robot.Robot, State=forward_kinematics.State, Display=3, High=56, Low=7, Page=0, Paged=False, Tool=448)
