# Grasshopper definition StdLibDoE.gh (Grasshopper 1.0.8)
# plug-ins: stdlib

# ---- group: Experimental Design
point_a = Point(Point(739.6210568, -11.25365906, 587.6820267))
point_b = Point(Point(739.6210568, 222.942548, 587.6820267))
point_c = Point(Point(498.3139314, -11.25365906, 587.6820267))
flange = Plane(Plane(origin=(533, 0, 889.1), x=(0, 0, -1), y=(0, 1, 0)))
paint = Point(Point(680.2962145, 158.332405, 587.6820267))
panel = Panel("""Speed 5 50
Offset 1 5""")
plane_3pt = Plane3Pt(PointA=point_a, PointB=point_b, PointC=point_c)
doe = Python3Script(Factors=panel, Replications=Slider(3, range=1..8))  # -> Messages, Experiments; inputs Factors: String, Replications: Int32
# ---------- doe: Python ----------
#-- random number generator
#--
from random import random, randint, seed
seed( 17 )

#-- parse factors
#--
levels  = []
factors = []
for entry in Factors.strip( ).split( '\n' ):
    name, low, high = entry.strip( ).split( )
    factors.append( name )
    levels.append( [float( low ), float( high )] )

#-- experiments
#--

k = len( factors )
K = 2 ** int( k )

#-- shuffle
#--
Order = [i for i in range( 0, K )]

for i in range( 0, K ):
    j = randint( 0, K - 1 )
    t = Order[i]
    Order[i] = Order[j]
    Order[j] = t

#-- text formatting
#--
maximum = 2 + len( max( factors, key = len ) )
padding = 6
column  = lambda value : str( value ).center( maximum )

#-- build design table
#--
header = column( "Index" ) + column( "Order" )
for factor in factors:
    header += column( factor )
    
for replication in range( 0, Replications ):
    header += column( "Repl%s" % ( 1 + replication ) )
    
print( header )

for i in range( 0, K ):
    row = column( i ) + column( Order[i] )
    
    for j in range( 0, int( k ) ):
      row += column( levels[j][( i >> j ) & 1] )

    for replication in range( 0, Replications ):
        row += column( "0.0" )

    print( row )
    

experiments = [0] * K
for i in range( 0, K ):
    experiments[Order[i]] = [levels[j][( i >> j ) & 1] 
        for j in range( 0, int( k ) )]

Experiments = []
for i in range( Replications ):
    Experiments += experiments

#import ghpythonlib.treehelpers as th
#Experiments = list(map(list, zip(*Experiments)))
#Experiments = th.list_to_tree( Experiments )
#print( Experiments )
# ---------- end doe ----------
edges = Python3Script(
    Experiments=doe.Experiments,
    WorkPlane=plane_3pt,
    Flange=flange,
    PaintPoint=paint,
    Dipping=Slider(2, range=0..5),
    LoadDelay=Slider(3, range=0..5),
    Retraction=Slider(25, range=0..100),
    Length=Slider(50, range=0..100),
    Spacing=Slider(15, range=0..100))  # -> Messages, graft(Points), Speeds, Delays; inputs Experiments: list, WorkPlane: Plane, Flange: Plane, PaintPoint: Point3d, Dipping: Double, LoadDelay: Double, Retraction: Double, Length: Double, Spacing: Double
# ---------- edges: Python ----------
from Rhino.Geometry import Point3d, Vector3d, Plane

Points = []
Speeds = []
Delays = []

def Add( x, y, z, speed, delay ):
    Points.append( Plane( WorkPlane.Origin +
                          WorkPlane.XAxis * x +
                          WorkPlane.YAxis * y +
                          WorkPlane.ZAxis * z,
                          Flange.XAxis,
                          Flange.YAxis ) )
    Speeds.append( speed )
    Delays.append( delay )

u = PaintPoint - WorkPlane.Origin
X = u * WorkPlane.XAxis
Y = u * WorkPlane.YAxis
Z = u * WorkPlane.ZAxis

x, y, z = 0.0, 0.0, 0.0
R, L, D, W, B, F, N = Retraction, Length, Spacing, LoadDelay, Dipping, 50.0, 0.001

for ( S, O ) in Experiments:
    Add( X + 0, Y, Z + R, F, N )
    Add( X + 0, Y, Z - B, F, N )
    Add( X + 0, Y, Z + R, F, W )
    Add( x + 0, y, z + R, F, N )
    Add( x + 0, y, z - O, S, N )
    Add( x + L, y, z - O, S, N )
    Add( x + L, y, z + R, F, N )
    y += D
# ---------- end edges ----------
panel_2 = Panel(doe.Experiments)
panel_3 = Panel(doe.Messages)

# ---- group: Motion Planning
pose_settings = PoseSettings(Basis=1, Elbow=1, Page=2, Paged=False, Wrist=0)
robot_task = RobotTask(
    Position_Velocity=edges.Speeds,
    Rotation_Velocity="500",
    Control=0,
    Modify=0,
    Motion=0,
    Page=2,
    Paged=True,
    Signals=0,
    Syntax=0)
model_robot = ModelRobot(Configuration="IRB1205", Page=0, Paged=False, Range=0)  # -> Robot, Ranges
robot_task_2 = RobotTask(Robot=edges.Delays, Control=1, Modify=0, Motion=0, Page=2, Paged=True, Signals=0, Syntax=0)
entwine = Entwine(Branch00=robot_task, Branch01=robot_task_2, FlattenInputs=True)
flip_matrix = FlipMatrix(Data=entwine)
robot_task_3 = RobotTask(Operations=flip_matrix, Control=0, Modify=2, Motion=0, Page=4, Paged=True, Signals=0, Syntax=0)
robot_task_4 = RobotTask(
    Robot=model_robot.Robot,
    Joints=edges.Points,
    Before=pose_settings,
    Before_2=robot_task_3,
    Control=0,
    Modify=0,
    Motion=2,
    Page=0,
    Paged=True,
    Signals=0,
    Syntax=0)  # -> flatten(Task)
robot_task_5 = RobotTask(Robot=robot_task_4, Control=0, Modify=1, Motion=0, Page=4, Paged=True, Signals=0, Syntax=0)

# ---- group: Code Generation
machine_code = MachineCode(Tasks=flatten(robot_task_5), Compact=1, Datum=1, Digits=3, Page=0, Paged=False, Type=302)  # -> Code, Report
text_join = TextJoin(Text=machine_code.Code)

# ----
panel_4 = Panel(machine_code.Code)

# ---- group: Simulation
display_robot_motion = DisplayRobotMotion(Task=robot_task_5, Major=9, Minor=0)  # -> State, Target
display_robot_model = DisplayRobotModel(Robot=model_robot.Robot, State=display_robot_motion.State, Display=3, High=56, Low=7, Page=3, Paged=False, Tool=192)

# ---- group: Program Uploader
file_transfer_request = FileTransferRequest(
    Host="192.168.125.1:21",
    Username="Student",
    Password="p a s s w o r d",
    Location="/Users/Students/stdlib.mod",
    Contents=text_join,
    Operation=1,
    Page=1,
    Paged=False,
    Protocol=0)  # disabled
panel_5 = Panel(file_transfer_request)
