# Grasshopper definition StdLibDoE2.gh (Grasshopper 1.0.8)
# plug-ins: stdlib

# ---- group: Experimenta Design to Code Generation
pose_settings = PoseSettings(Basis=1, Elbow=1, Page=2, Paged=False, Wrist=0)
model_robot = ModelRobot(Configuration="IRB1205", Page=0, Paged=False, Range=0)  # -> Robot, Ranges
point_a = Point(Point(739.6210568, -11.25365906, 587.6820267))
point_b = Point(Point(739.6210568, 222.942548, 587.6820267))
point_c = Point(Point(498.3139314, -11.25365906, 587.6820267))
flange = Plane(Plane(origin=(533, 0, 889.1), x=(0, 0, -1), y=(0, 1, 0)))
paint = Point(Point(680.2962145, 158.332405, 587.6820267))
panel = Panel("""Speed 5 50
Offset 1 5""")
plane_3pt = Plane3Pt(PointA=point_a, PointB=point_b, PointC=point_c)
doe = Python3Script(Factors=panel, Replications=Slider(3, range=1..8))  # -> Messages, Experiments; inputs Factors: String, Replications: Int32
# ---------- doe: Python ----------
#-- random number generator
#--
from random import random, randint, seed
seed( 17 )

#-- parse factors
#--
levels  = []
factors = []
for entry in Factors.strip( ).split( '\n' ):
    name, low, high = entry.strip( ).split( )
    factors.append( name )
    levels.append( [float( low ), float( high )] )

#-- experiments
#--

k = len( factors )
K = 2 ** int( k )

#-- shuffle
#--
Order = [i for i in range( 0, K )]

for i in range( 0, K ):
    j = randint( 0, K - 1 )
    t = Order[i]
    Order[i] = Order[j]
    Order[j] = t

#-- text formatting
#--
maximum = 2 + len( max( factors, key = len ) )
padding = 6
column  = lambda value : str( value ).center( maximum )

#-- build design table
#--
header = column( "Index" ) + column( "Order" )
for factor in factors:
    header += column( factor )
    
for replication in range( 0, Replications ):
    header += column( "Repl%s" % ( 1 + replication ) )
    
print( header )

for i in range( 0, K ):
    row = column( i ) + column( Order[i] )
    
    for j in range( 0, int( k ) ):
      row += column( levels[j][( i >> j ) & 1] )

    for replication in range( 0, Replications ):
        row += column( "0.0" )

    print( row )
    

experiments = [0] * K
for i in range( 0, K ):
    experiments[Order[i]] = [levels[j][( i >> j ) & 1] 
        for j in range( 0, int( k ) )]

Experiments = []
for i in range( Replications ):
    Experiments += experiments

#import ghpythonlib.treehelpers as th
#Experiments = list(map(list, zip(*Experiments)))
#Experiments = th.list_to_tree( Experiments )
#print( Experiments )
# ---------- end doe ----------
edges = Python3Script(
    Robot=model_robot.Robot,
    RobotPose=pose_settings,
    Experiments=doe.Experiments,
    WorkPlane=plane_3pt,
    Flange=flange,
    PaintPoint=paint,
    Dipping=Slider(2, range=0..5),
    LoadDelay=Slider(3, range=0..5),
    Retraction=Slider(25, range=0..100),
    Length=Slider(50, range=0..100),
    Spacing=Slider(10, range=0..100))  # -> Messages, Code, Planes, Path; inputs RobotPose: Int32, Experiments: list, WorkPlane: Plane, Flange: Plane, PaintPoint: Point3d, Dipping: Double, LoadDelay: Double, Retraction: Double, Length: Double, Spacing: Double
# ---------- edges: Python ----------
#-- References
#--
from Rhino.Geometry import Point3d, Vector3d, Plane, Polyline
from Std.Geometry import Mat4List
from Std.Robotics import SettingsRobot, Pose, Tasks, Task, Compact, Comment, Motion, Sleep, PathPolygon, Speed, CodeGenerationOptionsABBRapid, Datum
from Gha import Interoperability as ghi
from math import pi

#-- Conversions
#--
def PlaneTarget( x, y, z ):
    return Plane( WorkPlane.Origin +
                   WorkPlane.XAxis * x +
                   WorkPlane.YAxis * y +
                   WorkPlane.ZAxis * z,
                   Flange.XAxis,
                   Flange.YAxis )

def PlanesToTargets( planes ):
    targets = Mat4List( )
    for plane in planes:
        targets.Add( ghi.ToMat4( plane ) )
    return targets

#-- Task Definition
#--
tasks = Tasks( )

settings = SettingsRobot( )
settings.Kinematics = Robot.Kinematics
settings.InitialPose = Pose( RobotPose )

task = Task( settings )
tasks.Add( task )

Planes = []

x, y, z = 0.0, 0.0, 0.0

#-- Ink 
#--
u = PaintPoint - WorkPlane.Origin
X = u * WorkPlane.XAxis
Y = u * WorkPlane.YAxis
Z = u * WorkPlane.ZAxis

last_speed = -1.0

def AddWayPoint( plane, speed, delay, comment = '' ):
    if( comment != '' ):
        task.Add( Comment( task, comment ) )

    global last_speed
    if( speed != last_speed ):
        task.Add( Speed( task, 0.0, speed, 0.0, 500.0, 0.0 ) )
        last_speed = speed

    if( delay != 0.0 ):
        task.Add( Sleep( task, delay ) )
                   
    motion = Motion( task )    
    motion.Path = PathPolygon( motion, PlanesToTargets( [plane] ) )
    task.Add( motion )

    Planes.append( plane )

R, L, D, W, B, F, N = Retraction, Length, Spacing, LoadDelay, Dipping, 50.0, 0.0

for index, ( S, O ) in enumerate( Experiments ):
    task.Add( Comment( task, f'Experiment {index}' ) )

    AddWayPoint( PlaneTarget( X + 0, Y, Z + R ), F, N, 'Above Ink'         )
    AddWayPoint( PlaneTarget( X + 0, Y, Z - B ), F, N, 'Dip into Ink'      ) 
    AddWayPoint( PlaneTarget( X + 0, Y, Z + R ), F, W, 'Above Ink'         ) 
    AddWayPoint( PlaneTarget( x + 0, y, z + R ), F, N, 'Above Start Point' )
    AddWayPoint( PlaneTarget( x + 0, y, z - O ), S, N, 'Start Point'       )
    AddWayPoint( PlaneTarget( x + L, y, z - O ), S, N, 'End Point'         ) 
    AddWayPoint( PlaneTarget( x + L, y, z + R ), F, N, 'Above End Point'   )

    y += Spacing
 
#-- Code Generation
#--
options = CodeGenerationOptionsABBRapid( 1, 180/pi )
options.ModuleName = 'StdLib'
options.Digits = 4
options.Compaction = Compact.Some
options.Datum = Datum.Flange

engine = options.Generator( )
engine.Generate( tasks )

Code = engine.Code

Path = Polyline( [plane.Origin for plane in Planes] )
# ---------- end edges ----------
panel_2 = Panel(edges.Code)
panel_3 = Panel(doe.Messages)

# ---- group: Simulation
robot_task = RobotTask(
    Robot=model_robot.Robot,
    Joints=edges.Planes,
    Before=pose_settings,
    Control=0,
    Modify=0,
    Motion=2,
    Page=0,
    Paged=True,
    Signals=0,
    Syntax=0)
display_robot_motion = DisplayRobotMotion(Task=robot_task, Major=0, Minor=0)  # -> State, Target
display_robot_model = DisplayRobotModel(Robot=model_robot.Robot, State=display_robot_motion.State, Display=3, High=56, Low=7, Page=3, Paged=False, Tool=192)

# ---- group: Program Uploader
text_join = TextJoin(Text=edges.Code)
file_transfer_request = FileTransferRequest(
    Host="192.168.125.1:21",
    Username="Student",
    Password="p a s s w o r d",
    Location="/Users/Students/stdlib.mod",
    Contents=text_join,
    Operation=1,
    Page=1,
    Paged=False,
    Protocol=0)  # disabled
panel_4 = Panel(file_transfer_request)
