# Grasshopper definition StdLibFK.gh (Grasshopper 1.0.8)
# plug-ins: stdlib

model_robot = ModelRobot(Configuration="IRB1205", Page=0, Paged=False, Range=0)  # -> Robot, Ranges
number_vector = NumberVector(A=model_robot.Ranges, Value0=0, Value1=0, Value2=0, Value3=0, Value4=0, Value5=0)
forward_kinematics = ForwardKinematics(Robot=model_robot.Robot, Joints=number_vector)  # -> State, Planes
display_robot_model = DisplayRobotModel(Robot=model_robot.Robot, State=forward_kinematics.State, Display=3, High=56, Low=7, Page=3, Paged=False, Tool=192)
