# Grasshopper definition StdLibFkPath.gh (Grasshopper 1.0.8)
# plug-ins: stdlib

model_robot = ModelRobot(Configuration="IRB1205", Page=0, Paged=False, Range=0)  # -> Robot, Ranges
number_vector = NumberVector(A=model_robot.Ranges, Value0=0, Value1=0, Value2=0, Value3=0, Value4=0, Value5=0)
number_vector_2 = NumberVector(
    A=model_robot.Ranges,
    Value0=0.4830097232,
    Value1=0.4640681655,
    Value2=0.2719466509,
    Value3=0,
    Value4=-0.6859549851,
    Value5=0)
number_vector_3 = NumberVector(A=model_robot.Ranges, Value0=0, Value1=0, Value2=0, Value3=0, Value4=0, Value5=0)
list_edit = ListEdit(List0=number_vector, List1=number_vector_2, List2=number_vector_3, Action=2, Page=0, Paged=False)
robot_task = RobotTask(
    Robot=model_robot.Robot,
    Joints=list_edit,
    Connect=0,
    Control=0,
    Modify=0,
    Motion=0,
    Page=0,
    Paged=True,
    Signals=0,
    Syntax=0)
display_robot_motion = DisplayRobotMotion(Task=robot_task, Major=0, Minor=0)  # -> State, Target
display_robot_model = DisplayRobotModel(Robot=model_robot.Robot, State=display_robot_motion.State, Display=3, High=56, Low=7, Page=3, Paged=False, Tool=192)
