# Grasshopper definition StdLibIK.gh (Grasshopper 1.0.8)
# plug-ins: stdlib

plane = Plane(Plane(origin=(533, 0, 889.1), x=(0, 0, -1), y=(0, 1, 0)))
model_robot = ModelRobot(Configuration="IRB1205", Page=0, Paged=False, Range=0)  # -> Robot, Ranges
inverse_kinematics = InverseKinematics(Robot=model_robot.Robot, Target=plane)
pose_settings = PoseSettings(Value=inverse_kinematics, Basis=1, Elbow=1, Page=0, Paged=False, Wrist=1)
forward_kinematics = ForwardKinematics(Robot=model_robot.Robot, Joints=pose_settings)  # -> State, Planes
display_robot_model = DisplayRobotModel(Robot=model_robot.Robot, State=forward_kinematics.State, Display=3, High=56, Low=7, Page=3, Paged=False, Tool=192)
