# Grasshopper definition StdLibJoints.gh (Grasshopper 1.0.8)
# plug-ins: stdlib

# ---- group: Model Definition
model_robot = ModelRobot(Configuration="IRB1205", Page=0, Paged=False, Range=1)  # -> Robot, Ranges

# ---- group: Geometry
number_vector = NumberVector(
    A=model_robot.Ranges,
    Value0=40.85271318,
    Value1=53.33333333,
    Value2=-59.76744186,
    Value3=23.02325581,
    Value4=41.32,
    Value5=-90.5)
number_vector_2 = NumberVector(A=model_robot.Ranges, Value0=30.31007752, Value1=53.33333333, Value2=-24.96, Value3=65.46, Value4=41.32, Value5=-90.5)
number_vector_3 = NumberVector(A=model_robot.Ranges, Value0=41.25, Value1=56.81, Value2=-24.96, Value3=65.46, Value4=41.32, Value5=-90.5)
number_vector_4 = NumberVector(A=model_robot.Ranges, Value0=30.31007752, Value1=56.81, Value2=-24.96, Value3=65.46, Value4=41.32, Value5=-90.5)
radians = Radians(Degrees=number_vector)
radians_2 = Radians(Degrees=number_vector_3)
radians_3 = Radians(Degrees=number_vector_4)
radians_4 = Radians(Degrees=number_vector_2)
list_edit = ListEdit(List0=radians_2, List1=radians, List2=radians_4, List3=radians_3, Action=2, Page=0, Paged=False)

# ---- group: Motion Planning
_1 = Integer(1)
robot_task = RobotTask(Robot="DO15", Control=0, Modify=0, Motion=0, Page=1, Paged=True, Signals=0, Syntax=0)
robot_task_2 = RobotTask(Robot="DO15", Value=_1, Control=0, Modify=0, Motion=0, Page=1, Paged=True, Signals=1, Syntax=0)
robot_task_3 = RobotTask(
    Robot=model_robot.Robot,
    Joints=list_edit,
    Before=robot_task,
    After=robot_task_2,
    Control=0,
    Modify=0,
    Motion=0,
    Page=0,
    Paged=True,
    Signals=0,
    Syntax=0)

# ---- group: Code Generation
machine_code = MachineCode(Tasks=robot_task_3, Compact=0, Datum=1, Digits=6, Page=2, Paged=False, Type=302)  # -> Code, Report
text_join = TextJoin(Text=machine_code.Code)

# ---- group: File Transfer
file_transfer_request = FileTransferRequest(
    Host="192.168.125.1:21",
    Username="Student",
    Password="p a s s w o r d",
    Location="/Users/Students/stdlib.mod",
    Contents=text_join,
    Operation=1,
    Page=0,
    Paged=False,
    Protocol=0)  # disabled
panel = Panel(file_transfer_request)

# ---- group: Simulation
display_robot_motion = DisplayRobotMotion(Task=robot_task_3, Major=0, Minor=0)  # -> State, Target
display_robot_model = DisplayRobotModel(Robot=model_robot.Robot, State=display_robot_motion.State, Display=3, High=56, Low=7, Page=0, Paged=False, Tool=448)
