# Grasshopper definition StdLibMotion.gh (Grasshopper 1.0.8)
# plug-ins: stdlib

pose_settings = PoseSettings(Basis=1, Elbow=1, Page=2, Paged=False, Wrist=0)
plane = Plane(Plane(origin=(636.5321492, 103.3785476, 523.9700146), x=(-0.04939176984, -0.008021667779, -0.9987472683), y=(-0.1603085532, 0.987066952, 0)))
plane_2 = Plane(Plane(origin=(336.0167056, 301.1815766, 649.691397), x=(0.3232117609, 0.4542459266, -0.8301775688), y=(-0.5027593788, 0.8256415596, 0.2560254325)))
plane_3 = Plane(Plane(origin=(444.7024288, -267.5450713, 733.624394), x=(0, 0, -1), y=(0, 1, 0)))
merge = Merge(Data1=plane_3, Data2=plane, Data3=plane_2)
model_robot = ModelRobot(Configuration="IRB1205", Page=0, Paged=False, Range=0)  # -> Robot, Ranges
robot_task = RobotTask(
    Robot=model_robot.Robot,
    Joints=merge,
    Before=pose_settings,
    Connect=0,
    Control=0,
    Modify=0,
    Motion=2,
    Page=0,
    Paged=True,
    Signals=0,
    Syntax=0)
display_robot_motion = DisplayRobotMotion(Task=robot_task, Major=2, Minor=0)  # -> State, Target
display_robot_model = DisplayRobotModel(Robot=model_robot.Robot, State=display_robot_motion.State, Display=3, High=56, Low=7, Page=3, Paged=False, Tool=192)
display_joint_traces = DisplayJointTraces(State=display_robot_model, Base=0, High=64, Low=0, Page=0, Paged=False, Tool=256)
