# Grasshopper definition StdLibPnP.gh (Grasshopper 1.0.8)
# plug-ins: stdlib

# ---- group: Process Parmeters
item_count = Slider(2, range=1..10)
item_spacing = Slider(75, range=0..100)
clearance = Slider(100, range=0..100)

# ---- group: Calibration Points Acquired
pick_source = Point(Point(467.6610905, -199.3465172, 378.4185109))
flange = Plane(Plane(origin=(799.0159414, 256.4021291, 414.1020739), x=(-0.03196012674, -0.7137036927, -0.6997182214), y=(-0.1240003695, 0.6974985955, -0.7057758976)))
place_target = Point(Point(483.9775951, 50.99139128, 370.6817811))
deconstruct_plane = DeconstructPlane(Plane=flange)  # -> Origin, XAxis, YAxis, ZAxis

# ---- group: Points Above Pick Source
# Geometric Modeling
unit_z = UnitZ(Factor=clearance)
addition = Addition(A=pick_source, B=unit_z)
construct_plane = ConstructPlane(Origin=addition, XAxis=deconstruct_plane.XAxis, YAxis=deconstruct_plane.YAxis)
duplicate_data = DuplicateData(Data=construct_plane, Number=item_count, Order=True)

# ---- group: Target Locations
series = Series(Start=0, Step=item_spacing, Count=item_count)
unit_z_2 = UnitZ(Factor=series)
addition_2 = Addition(A=place_target, B=unit_z_2)
construct_plane_2 = ConstructPlane(Origin=addition_2, XAxis=deconstruct_plane.XAxis, YAxis=deconstruct_plane.YAxis)

# ---- group: Points at Pick Source
construct_plane_3 = ConstructPlane(Origin=pick_source, XAxis=deconstruct_plane.XAxis, YAxis=deconstruct_plane.YAxis)
duplicate_data_2 = DuplicateData(Data=construct_plane_3, Number=item_count, Order=True)

# ---- group: 3. Points Above Place Target
unit_z_3 = UnitZ(Factor=clearance)
addition_3 = Addition(A=addition_2, B=unit_z_3)
construct_plane_4 = ConstructPlane(Origin=addition_3, XAxis=deconstruct_plane.XAxis, YAxis=deconstruct_plane.YAxis)

# ---- group: Build Waypoint Sequence
# Data Structuring
entwine = Entwine(
    Branch0X=duplicate_data,
    Branch1X=duplicate_data_2,
    Branch2X=duplicate_data,
    Branch3X=construct_plane_4,
    Branch4X=construct_plane_2,
    Branch5X=construct_plane_4,
    FlattenInputs=False)
flip_matrix = FlipMatrix(Data=entwine)
split_list = SplitList(List=flatten(flip_matrix), Index="2")  # -> ListA, ListB
partition_list = PartitionList(List=split_list.ListB, Size="3")

# ----
_1010 = Python3Script(planes=split_list.ListB)  # -> pattern, count; inputs planes: list
# ---------- _1010: Python ----------
import math
count = math.ceil( len( planes ) / 3 )
pattern = [1 - ( index & 1 )
    for index in range( count )]
# ---------- end _1010 ----------
robot_task = RobotTask(Robot="Pick | Place", Control=1, Modify=0, Motion=0, Page=3, Paged=True, Signals=0, Syntax=0)
robot_task_2 = RobotTask(Robot="Initialize", Control=1, Modify=0, Motion=0, Page=3, Paged=True, Signals=0, Syntax=0)
robot_task_3 = RobotTask(Robot="DO15", Value=_1010.pattern, Control=0, Modify=0, Motion=0, Page=1, Paged=True, Signals=1, Syntax=0)
robot_task_4 = RobotTask(Robot="1", Control=1, Modify=0, Motion=0, Page=2, Paged=True, Signals=0, Syntax=0)
robot_task_5 = RobotTask(Robot="0.5", Control=1, Modify=0, Motion=0, Page=2, Paged=True, Signals=0, Syntax=0)
robot_task_6 = RobotTask(Robot="DO15", Control=0, Modify=0, Motion=0, Page=1, Paged=True, Signals=0, Syntax=0)
duplicate_data_3 = DuplicateData(Data=robot_task, Number=_1010.count, Order=True)
duplicate_data_4 = DuplicateData(Data=robot_task_5, Number=_1010.count, Order=True)
duplicate_data_5 = DuplicateData(Data=robot_task_4, Number=_1010.count, Order=True)
entwine_2 = Entwine(
    Branch00=duplicate_data_3,
    Branch01=duplicate_data_4,
    Branch02=robot_task_3,
    Branch03=duplicate_data_5,
    FlattenInputs=True)
merge = Merge(Data1=robot_task_2, Data2=robot_task_6)
flip_matrix_2 = FlipMatrix(Data=entwine_2)
# Motion Planning
panel = Panel("IRB1205")
pose_settings = PoseSettings(Basis=1, Elbow=1, Page=2, Paged=False, Wrist=0)
model_robot = ModelRobot(Configuration=panel, Page=0, Paged=False, Range=0)  # -> Robot, Ranges
robot_task_7 = RobotTask(Operations=merge, Control=1, Modify=2, Motion=0, Page=4, Paged=True, Signals=0, Syntax=0)
robot_task_8 = RobotTask(Operations=flip_matrix_2, Control=1, Modify=2, Motion=0, Page=4, Paged=True, Signals=0, Syntax=0)
robot_task_9 = RobotTask(
    Robot=model_robot.Robot,
    Joints=partition_list,
    Before=pose_settings,
    Before_2=robot_task_8,
    Control=0,
    Modify=0,
    Motion=2,
    Page=0,
    Paged=True,
    Signals=0,
    Syntax=0)  # -> flatten(Task)
robot_task_10 = RobotTask(
    Robot=model_robot.Robot,
    Joints=split_list.ListA,
    Before=pose_settings,
    Before_2=robot_task_7,
    Control=0,
    Modify=0,
    Motion=2,
    Page=0,
    Paged=True,
    Signals=0,
    Syntax=0)
entwine_3 = Entwine(Branch00=robot_task_10, Branch01=robot_task_9, FlattenInputs=True)  # -> flatten(Result)
robot_task_11 = RobotTask(Robot=entwine_3, Control=0, Modify=1, Motion=0, Page=4, Paged=True, Signals=0, Syntax=0)

# ---- group: Machine Code Compiler
machine_code = MachineCode(Tasks=robot_task_11, Compact=1, Datum=1, Digits=3, Page=3, Paged=False, Type=302)  # -> Code, Report
text_join = TextJoin(Text=machine_code.Code)

# ---- group: Program Uploader
file_transfer_request = FileTransferRequest(
    Host="192.168.125.1:21",
    Username="Student",
    Password="p a s s w o r d",
    Location="/Users/Students/stdlib.mod",
    Contents=text_join,
    Operation=1,
    Page=1,
    Paged=False,
    Protocol=0)  # disabled
panel_2 = Panel(file_transfer_request)

# ---- group: Simulation
# Simulation and Compilation
display_robot_motion = DisplayRobotMotion(Task=robot_task_11, Major=5, Minor=0)  # -> State, Target
display_robot_model = DisplayRobotModel(Robot=model_robot.Robot, State=display_robot_motion.State, Display=3, High=56, Low=7, Page=3, Paged=False, Tool=192)
