# Grasshopper definition StdLibSmooth.gh (Grasshopper 1.0.8)
# plug-ins: stdlib

curve = Curve(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)
curve_frames = CurveFrames(Curve=curve, Count=Slider(64, range=4..64))  # -> Frames, Parameters
deconstruct_plane = DeconstructPlane(Plane=curve_frames.Frames)  # -> Origin, XAxis, YAxis, ZAxis
# Geometric Modeling
unit_y = UnitY(Factor=1)
unit_x = UnitX(Factor=1)
unit_z = UnitZ(Factor=1)
construct_plane = ConstructPlane(Origin=deconstruct_plane.Origin, XAxis=unit_y, YAxis=unit_x)
construct_plane_2 = ConstructPlane(Origin=deconstruct_plane.Origin, XAxis=deconstruct_plane.XAxis, YAxis=deconstruct_plane.YAxis)
construct_plane_3 = ConstructPlane(Origin=deconstruct_plane.Origin, XAxis=deconstruct_plane.YAxis, YAxis=deconstruct_plane.XAxis)
construct_plane_4 = ConstructPlane(Origin=deconstruct_plane.Origin, XAxis=deconstruct_plane.YAxis, YAxis=deconstruct_plane.ZAxis)
construct_plane_5 = ConstructPlane(Origin=deconstruct_plane.Origin, XAxis=deconstruct_plane.YAxis, YAxis=unit_z)
entwine = Entwine(
    Branch00=construct_plane,
    Branch01=construct_plane_5,
    Branch02=construct_plane_2,
    Branch03=construct_plane_3,
    Branch04=construct_plane_4,
    FlattenInputs=True)
flip_matrix = FlipMatrix(Data=entwine)
list_item = ListItem(List=flip_matrix, Index=Slider(0, range=0..5), Wrap=True)  # -> flatten(Item)

# ---- group: Kinematics & Geometric Model Definition
pose_settings = PoseSettings(Basis=1, Elbow=1, Page=2, Paged=False, Wrist=0)
# Motion Planning
panel = Panel("IRB1205")
robot_task = RobotTask(
    Position_Velocity="50",
    Rotation_Velocity="500",
    Blend_Radius="0",
    Control=0,
    Modify=0,
    Motion=0,
    Page=2,
    Paged=True,
    Signals=0,
    Syntax=0)
model_robot = ModelRobot(Configuration=panel, Page=0, Paged=False, Range=0)  # -> Robot, Ranges
robot_task_2 = RobotTask(
    Robot=model_robot.Robot,
    Joints=list_item,
    Before=pose_settings,
    Before_2=robot_task,
    Control=0,
    Modify=0,
    Motion=2,
    Page=0,
    Paged=True,
    Signals=0,
    Syntax=0)  # -> flatten(Task)

# ---- group: Machine Code Compiler
machine_code = MachineCode(Tasks=robot_task_2, Compact=0, Datum=1, Digits=3, Page=3, Paged=False, Type=302)  # -> Code, Report
text_join = TextJoin(Text=machine_code.Code)

# ---- group: Program Uploader
file_transfer_request = FileTransferRequest(
    Host="192.168.125.1:21",
    Username="Student",
    Password="p a s s w o r d",
    Location="/Users/Students/stdlib.mod",
    Contents=text_join,
    Operation=1,
    Page=1,
    Paged=False,
    Protocol=0)  # disabled
panel_2 = Panel(file_transfer_request)

# ---- group: Simulation
# Simulation and Compilation
display_robot_motion = DisplayRobotMotion(Task=robot_task_2, Major=0, Minor=0)  # -> State, Target
display_robot_model = DisplayRobotModel(Robot=model_robot.Robot, State=display_robot_motion.State, Display=3, High=56, Low=7, Page=0, Paged=False, Tool=192)
