# Grasshopper definition StdLibSmoothCode.gh (Grasshopper 1.0.8)
# plug-ins: stdlib

curve = Curve(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)

# ---- group: Experimenta Design to Code Generation
pose_settings = PoseSettings(Basis=1, Elbow=1, Page=2, Paged=False, Wrist=0)
model_robot = ModelRobot(Configuration="IRB1205", Page=0, Paged=False, Range=0)  # -> Robot, Ranges
edges = Python3Script(Robot=model_robot.Robot, RobotPose=pose_settings, Path=curve)  # -> Messages, Code, Planes, Path; inputs RobotPose: Int32, Path: Curve
# ---------- edges: Python ----------
#-- Plane to Matrix Conversion
#--
from Std.Geometry import Mat4List, Vec1
from Gha import Interoperability
def PlanesToTargets( planes ):
    targets = Mat4List( )
    for plane in planes:
        targets.Add( Interoperability.ToMat4( plane ) )
    return targets

#-- Robot Settings
#--
from Std.Robotics import SettingsRobot, Pose
settings = SettingsRobot( )
settings.Kinematics = Robot.Kinematics
settings.InitialPose = Pose( RobotPose )

#-- Task Definition
#--
from Std.Robotics import Tasks, Task
tasks = Tasks( )

#-- Waypoint with Optional Events
#--
from Std.Robotics import Comment, Speed, Sleep, Motion, PathPolygon
def AddWayPoints( task, planes, speed = 0.0, blend = 0.0, delay = 0.0, comment = '' ):
    if( comment != '' ):
        task.Add( Comment( task, comment ) )

    if( speed > 0.0 ):
        task.Add( Speed( task, 0.0, speed, 0.0, 500.0, blend ) )

    if( delay > 0.0 ):
        task.Add( Sleep( task, delay ) )
                   
    motion = Motion( task )    
    motion.Path = PathPolygon( motion, PlanesToTargets( planes ) )
    task.Add( motion )

#-- Geometric Modeling
#--
from Rhino.Geometry import Point3d, Vector3d, Plane, Polyline, Curve
Planes = []
for param in Path.DivideByCount( 10, True ):
    _, plane = Path.FrameAt( param )
    Planes.append( Plane( plane.Origin, plane.XAxis, plane.ZAxis ) )

#-- Linear Motion with Before Events
#--
task = Task( settings )
AddWayPoints( task, Planes, speed=50.0, blend=1.0, 
    comment='Constant Speed' )
tasks.Add( task )

#-- Linear Motion with Every Waypoint Events 
#--
task = Task( settings )
for index, plane in enumerate( Planes ):
    time  = index / ( len( Planes ) - 1 )
    speed = 10 + 40 * time
    AddWayPoints( task, [plane], speed=speed, blend=1.0, 
        comment=f'Progress {time*100:.1f}%' )
tasks.Add( task )

#-- Code Generation
#--
from Std.Robotics import CodeGenerationOptionsABBRapid, Compact, Datum
options = CodeGenerationOptionsABBRapid( 1.0, Vec1.R2D )
options.ModuleName = 'StdLib'
options.Digits = 4
options.Compaction = Compact.Some
options.Datum = Datum.Flange

engine = options.Generator( )
engine.Generate( tasks )
Code = engine.Code
# ---------- end edges ----------
panel = Panel(edges.Code)

# ---- group: Simulation
robot_task = RobotTask(
    Robot=model_robot.Robot,
    Joints=edges.Planes,
    Before=pose_settings,
    Control=0,
    Modify=0,
    Motion=2,
    Page=0,
    Paged=True,
    Signals=0,
    Syntax=0)
display_robot_motion = DisplayRobotMotion(Task=robot_task, Major=0, Minor=0)  # -> State, Target
display_robot_model = DisplayRobotModel(Robot=model_robot.Robot, State=display_robot_motion.State, Display=3, High=56, Low=7, Page=3, Paged=False, Tool=192)

# ---- group: Program Uploader
text_join = TextJoin(Text=edges.Code)
file_transfer_request = FileTransferRequest(
    Host="192.168.125.1:21",
    Username="Student",
    Password="p a s s w o r d",
    Location="/Users/Students/stdlib.mod",
    Contents=text_join,
    Operation=1,
    Page=1,
    Paged=False,
    Protocol=0)  # disabled
panel_2 = Panel(file_transfer_request)
