# Grasshopper definition StdLibTools.gh (Grasshopper 1.0.8)
# plug-ins: stdlib

# ---- group: Tool Definition
geometry = Mesh(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)
point = Point(Point(93, 0, 26))
yz_plane = YZPlane(Origin=point)

# ---- group: Target Planes
plane = Plane(Plane(origin=(444.7024288, -267.5450713, 733.624394), x=(0, 0, -1), y=(0.9931733345, 0.1166478787, 0)))
plane_2 = Plane(Plane(origin=(636.5321492, 103.3785476, 523.9700146), x=(-0.04939176984, -0.008021667779, -0.9987472683), y=(0.6081814776, 0.7929609085, -0.0364456852)))
plane_3 = Plane(Plane(origin=(336.0167056, 301.1815766, 649.691397), x=(0.6561103796, -0.3485338505, -0.6693603849), y=(0.3514090255, 0.9260355743, -0.1377309404)))
merge = Merge(Data1=plane, Data2=plane_2, Data3=plane_3)

# ---- group: Tool Transform
xform = Python3Script(plane=merge, tool=yz_plane, active=Toggle(True))  # -> out, target; inputs plane: Plane, tool: Plane, active: Boolean
# ---------- xform: Python ----------
from Rhino.Geometry import Plane, Transform

target = plane.Clone( )

if( active ):
    p = Transform.PlaneToPlane( Plane.WorldXY, plane )
    P = Transform.PlaneToPlane( plane, Plane.WorldXY )
    T = Transform.PlaneToPlane( tool, Plane.WorldXY  )
    target.Transform( p * T * P  )
# ---------- end xform ----------

# ----
pose_settings = PoseSettings(Basis=1, Elbow=1, Page=2, Paged=False, Wrist=0)
model_robot = ModelRobot(Configuration="IRB1205", Page=0, Paged=False, Range=0)  # -> Robot, Ranges
robot_task = RobotTask(
    Robot=model_robot.Robot,
    Joints=xform.target,
    Before=pose_settings,
    Control=0,
    Modify=0,
    Motion=2,
    Page=0,
    Paged=True,
    Signals=0,
    Syntax=0)
display_robot_motion = DisplayRobotMotion(Task=robot_task, Major=0, Minor=0)  # -> State, Target
display_robot_model = DisplayRobotModel(Robot=model_robot.Robot, State=display_robot_motion.State, Display=3, High=56, Low=7, Page=0, Paged=False, Tool=192)

# ---- group: Tool Visualization
orient = Orient(Geometry=geometry, Source=PlaneXY(0, 0, 0), Target=display_robot_motion.Target)  # -> Geometry, Transform
custom_preview = CustomPreview(Geometry=orient.Geometry, Material=ColourSwatch(SwatchColor=RGB(53, 61, 22)))
